# Grasshopper definition 2 - URBANOData.gh (Grasshopper 1.0.7)
# plug-ins: Bifocals, Moonlight, Urbano

moonlight = Moonlight(Mode=invert(False))

# ----
# 52 - Trinity Place & Rector St
panel = Panel("-74.01447")
file_path = FilePath("D:\MaCad\A.I and M.L\studio\Data Set for Prediction\52 - Trinity Place & Rector St")
download_openstreetmap_osm = DownloadOpenStreetMapOSM(LeftBound=panel, RightBound="-74.01129", TopBound="40.70848", BottomBound="40.70706", FilePath=file_path, RunToggle=True)  # -> OSMQueryURL, OSMFilePath
file_path_2 = FilePath(download_openstreetmap_osm.OSMFilePath)
panel_2 = Panel(download_openstreetmap_osm.OSMQueryURL)

# ----
# 51 - Seventh Ave & W. 32nd St
panel_3 = Panel("-73.99352")
file_path_3 = FilePath("D:\MaCad\A.I and M.L\studio\Data Set for Prediction\51 - Seventh Ave & W. 32nd St")
download_openstreetmap_osm_2 = DownloadOpenStreetMapOSM(
    LeftBound=panel_3,
    RightBound="-73.99034",
    TopBound="40.74982",
    BottomBound="40.74840",
    FilePath=file_path_3,
    RunToggle=True)  # -> OSMQueryURL, OSMFilePath
file_path_4 = FilePath(download_openstreetmap_osm_2.OSMFilePath)
panel_4 = Panel(download_openstreetmap_osm_2.OSMQueryURL)

# ----
# 57 - W. 34th St & Boardway
panel_5 = Panel("40.75054")
file_path_5 = FilePath("D:\MaCad\A.I and M.L\studio\Data Set for Prediction\57 - W. 34th St & Boardway")
download_openstreetmap_osm_3 = DownloadOpenStreetMapOSM(
    LeftBound="-73.98931",
    RightBound="-73.98613",
    TopBound=panel_5,
    BottomBound="40.74912",
    FilePath=file_path_5,
    RunToggle=True)  # -> OSMQueryURL, OSMFilePath
file_path_6 = FilePath(download_openstreetmap_osm_3.OSMFilePath)
panel_6 = Panel(download_openstreetmap_osm_3.OSMQueryURL)

# ----
# 55 - W. 14th St & Hudson St
panel_7 = Panel("-74.00676")
file_path_7 = FilePath("D:\MaCad\A.I and M.L\studio\Data Set for Prediction\54 - W. 14th St & Hudson St")
download_openstreetmap_osm_4 = DownloadOpenStreetMapOSM(
    LeftBound=panel_7,
    RightBound="-74.00358",
    TopBound="40.74163",
    BottomBound="40.74021",
    FilePath=file_path_7,
    RunToggle=True)  # -> OSMQueryURL, OSMFilePath
file_path_8 = FilePath(download_openstreetmap_osm_4.OSMFilePath)
panel_8 = Panel(download_openstreetmap_osm_4.OSMQueryURL)

# ----
# 53 - Wall St & New St
panel_9 = Panel("40.70824")
file_path_9 = FilePath("D:\MaCad\A.I and M.L\studio\Data Set for Prediction\53 - Wall St & New St")
download_openstreetmap_osm_5 = DownloadOpenStreetMapOSM(
    LeftBound="-74.01286",
    RightBound="-74.00968",
    TopBound=panel_9,
    BottomBound="40.70682",
    FilePath=file_path_9,
    RunToggle=True)  # -> OSMQueryURL, OSMFilePath
file_path_10 = FilePath(download_openstreetmap_osm_5.OSMFilePath)
panel_10 = Panel(download_openstreetmap_osm_5.OSMQueryURL)

# ----
# 58 - W. 40th St & Ave of Americas
panel_11 = Panel("40.75426")
file_path_11 = FilePath("D:\MaCad\A.I and M.L\studio\Data Set for Prediction\58 - W. 40th St & Ave of Americas")
download_openstreetmap_osm_6 = DownloadOpenStreetMapOSM(
    LeftBound="-73.98655",
    RightBound="-73.98337",
    TopBound=panel_11,
    BottomBound="40.75284",
    FilePath=file_path_11,
    RunToggle=True)  # -> OSMQueryURL, OSMFilePath
file_path_12 = FilePath(download_openstreetmap_osm_6.OSMFilePath)
panel_12 = Panel(download_openstreetmap_osm_6.OSMQueryURL)

# ----
# 72- 73rd St & 37th Ave
panel_13 = Panel("40.74961")
file_path_13 = FilePath("D:\MaCad\A.I and M.L\studio\Data Set for Prediction\72- 73rd St & 37th Ave")
download_openstreetmap_osm_7 = DownloadOpenStreetMapOSM(
    LeftBound="-73.89418",
    RightBound="-73.89100",
    TopBound=panel_13,
    BottomBound="40.74819",
    FilePath=file_path_13,
    RunToggle=True)  # -> OSMQueryURL, OSMFilePath
file_path_14 = FilePath(download_openstreetmap_osm_7.OSMFilePath)
panel_14 = Panel(download_openstreetmap_osm_7.OSMQueryURL)

# ----
# 54 - W. 125th St & Adam C P Blvd
panel_15 = Panel("-73.94985")
file_path_15 = FilePath("D:\MaCad\A.I and M.L\studio\Data Set for Prediction\54 - W. 125th St & Adam C P Blvd")
download_openstreetmap_osm_8 = DownloadOpenStreetMapOSM(
    LeftBound=panel_15,
    RightBound="-73.94667",
    TopBound="40.80968",
    BottomBound="40.80826",
    FilePath=file_path_15,
    RunToggle=True)  # -> OSMQueryURL, OSMFilePath
file_path_16 = FilePath(download_openstreetmap_osm_8.OSMFilePath)
panel_16 = Panel(download_openstreetmap_osm_8.OSMQueryURL)

# ----
# 56 - W. 181St & St Nicholas Ave
panel_17 = Panel("-73.93206")
file_path_17 = FilePath("D:\MaCad\A.I and M.L\studio\Data Set for Prediction\56 - W. 181St & St Nicholas Ave")
download_openstreetmap_osm_9 = DownloadOpenStreetMapOSM(
    LeftBound="-73.93524",
    RightBound=panel_17,
    TopBound="40.85002",
    BottomBound="40.84860",
    FilePath=file_path_17,
    RunToggle=True)  # -> OSMQueryURL, OSMFilePath
file_path_18 = FilePath(download_openstreetmap_osm_9.OSMFilePath)
panel_18 = Panel(download_openstreetmap_osm_9.OSMQueryURL)

# ----
# 71- 165th St & 89th Ave
panel_19 = Panel("40.70845")
file_path_19 = FilePath("D:\MaCad\A.I and M.L\studio\Data Set for Prediction\71- 165th St & 89th Ave")
download_openstreetmap_osm_10 = DownloadOpenStreetMapOSM(
    LeftBound="-73.79789",
    RightBound="-73.79471",
    TopBound=panel_19,
    BottomBound="40.70703",
    FilePath=file_path_19,
    RunToggle=True)  # -> OSMQueryURL, OSMFilePath
file_path_20 = FilePath(download_openstreetmap_osm_10.OSMFilePath)
panel_20 = Panel(download_openstreetmap_osm_10.OSMQueryURL)

# ----
# 74- Austin St & 71st Ave
panel_21 = Panel("-73.84201")
file_path_21 = FilePath("D:\MaCad\A.I and M.L\studio\Data Set for Prediction\74- Austin St & 71st Ave")
download_openstreetmap_osm_11 = DownloadOpenStreetMapOSM(
    LeftBound="-73.84519",
    RightBound=panel_21,
    TopBound="40.72059",
    BottomBound="40.71917",
    FilePath=file_path_21,
    RunToggle=True)  # -> OSMQueryURL, OSMFilePath
file_path_22 = FilePath(download_openstreetmap_osm_11.OSMFilePath)
panel_22 = Panel(download_openstreetmap_osm_11.OSMQueryURL)

# ----
# 59- W. 47th St & Ave of Americas
panel_23 = Panel("40.75873")
file_path_23 = FilePath("D:\MaCad\A.I and M.L\studio\Data Set for Prediction\59- W. 47th St & Ave of Americas")
download_openstreetmap_osm_12 = DownloadOpenStreetMapOSM(
    LeftBound="-73.98336",
    RightBound="-73.98018",
    TopBound=panel_23,
    BottomBound="40.75731",
    FilePath=file_path_23,
    RunToggle=True)  # -> OSMQueryURL, OSMFilePath
file_path_24 = FilePath(download_openstreetmap_osm_12.OSMFilePath)
panel_24 = Panel(download_openstreetmap_osm_12.OSMQueryURL)

# ----
# 73- 82nd St & 37th Ave
panel_25 = Panel("-73.88578")
file_path_25 = FilePath("D:\MaCad\A.I and M.L\studio\Data Set for Prediction\73- 82nd St & 37th Ave")
download_openstreetmap_osm_13 = DownloadOpenStreetMapOSM(
    LeftBound=panel_25,
    RightBound="-73.88260",
    TopBound="40.75051",
    BottomBound="40.74909",
    FilePath=file_path_25,
    RunToggle=True)  # -> OSMQueryURL, OSMFilePath
file_path_26 = FilePath(download_openstreetmap_osm_13.OSMFilePath)
panel_26 = Panel(download_openstreetmap_osm_13.OSMQueryURL)

# ----
# 65- 50th St & 5Th Ave
panel_27 = Panel("-73.97552")
file_path_27 = FilePath("D:\MaCad\A.I and M.L\studio\Data Set for Prediction\66- 50th St & 5Th Ave")
download_openstreetmap_osm_14 = DownloadOpenStreetMapOSM(
    LeftBound="-73.97871",
    RightBound=panel_27,
    TopBound="40.75926",
    BottomBound="40.75784",
    FilePath=file_path_27,
    RunToggle=True)  # -> OSMQueryURL, OSMFilePath
file_path_28 = FilePath(download_openstreetmap_osm_14.OSMFilePath)
panel_28 = Panel(download_openstreetmap_osm_14.OSMQueryURL)

# ----
# 60- 50th St & Second Ave
panel_29 = Panel("-73.96683")
file_path_29 = FilePath("D:\MaCad\A.I and M.L\studio\Data Set for Prediction\60- 50th St & Second Ave")
download_openstreetmap_osm_15 = DownloadOpenStreetMapOSM(
    LeftBound="-73.97001",
    RightBound=panel_29,
    TopBound="40.75561",
    BottomBound="40.75419",
    FilePath=file_path_29,
    RunToggle=True)  # -> OSMQueryURL, OSMFilePath
file_path_30 = FilePath(download_openstreetmap_osm_15.OSMFilePath)
panel_30 = Panel(download_openstreetmap_osm_15.OSMQueryURL)

# ----
# 69- 50th St & 8th Ave
panel_31 = Panel("-73.98453")
file_path_31 = FilePath("D:\MaCad\A.I and M.L\studio\Data Set for Prediction\69- 50th St & 8th Ave")
download_openstreetmap_osm_16 = DownloadOpenStreetMapOSM(
    LeftBound="-73.98771",
    RightBound=panel_31,
    TopBound="40.76302",
    BottomBound="40.76160",
    FilePath=file_path_31,
    RunToggle=True)  # -> OSMQueryURL, OSMFilePath
file_path_32 = FilePath(download_openstreetmap_osm_16.OSMFilePath)
panel_32 = Panel(download_openstreetmap_osm_16.OSMQueryURL)

# ----
# 64- 50th St & Madison Ave
panel_33 = Panel("40.75845")
file_path_33 = FilePath("D:\MaCad\A.I and M.L\studio\Data Set for Prediction\64- 50th St & Madison Ave")
download_openstreetmap_osm_17 = DownloadOpenStreetMapOSM(
    LeftBound="-73.97718",
    RightBound="-73.97399",
    TopBound=panel_33,
    BottomBound="40.75703",
    FilePath=file_path_33,
    RunToggle=True)  # -> OSMQueryURL, OSMFilePath
file_path_34 = FilePath(download_openstreetmap_osm_17.OSMFilePath)
panel_34 = Panel(download_openstreetmap_osm_17.OSMQueryURL)

# ----
# 62- 50th St & Lexington Ave
panel_35 = Panel("40.75724")
file_path_35 = FilePath("D:\MaCad\A.I and M.L\studio\Data Set for Prediction\62- 50th St & Lexington Ave")
download_openstreetmap_osm_18 = DownloadOpenStreetMapOSM(
    LeftBound="-73.97390",
    RightBound="-73.97072",
    TopBound=panel_35,
    BottomBound="40.75582",
    FilePath=file_path_35,
    RunToggle=True)  # -> OSMQueryURL, OSMFilePath
file_path_36 = FilePath(download_openstreetmap_osm_18.OSMFilePath)
panel_36 = Panel(download_openstreetmap_osm_18.OSMQueryURL)

# ----
# 61- 50th St & Third Ave
panel_37 = Panel("-73.96906")
file_path_37 = FilePath("D:\MaCad\A.I and M.L\studio\Data Set for Prediction\61- 50th St & Third Ave")
download_openstreetmap_osm_19 = DownloadOpenStreetMapOSM(
    LeftBound="-73.97224",
    RightBound=panel_37,
    TopBound="40.75661",
    BottomBound="40.75519",
    FilePath=file_path_37,
    RunToggle=True)  # -> OSMQueryURL, OSMFilePath
file_path_38 = FilePath(download_openstreetmap_osm_19.OSMFilePath)
panel_38 = Panel(download_openstreetmap_osm_19.OSMQueryURL)

# ----
# 63- 50th St & Park Ave
panel_39 = Panel("40.75789")
file_path_39 = FilePath("D:\MaCad\A.I and M.L\studio\Data Set for Prediction\63- 50th St & Park Ave")
download_openstreetmap_osm_20 = DownloadOpenStreetMapOSM(
    LeftBound="-73.97558",
    RightBound="-73.97240",
    TopBound=panel_39,
    BottomBound="40.75647",
    FilePath=file_path_39,
    RunToggle=True)  # -> OSMQueryURL, OSMFilePath
file_path_40 = FilePath(download_openstreetmap_osm_20.OSMFilePath)
panel_40 = Panel(download_openstreetmap_osm_20.OSMQueryURL)

# ----
# 75- Bell Bvld & 40th Ave
panel_41 = Panel("-73.77278")
file_path_41 = FilePath("D:\MaCad\A.I and M.L\studio\Data Set for Prediction\75- Bell Bvld & 40th Ave")
download_openstreetmap_osm_21 = DownloadOpenStreetMapOSM(
    LeftBound=panel_41,
    RightBound="-73.76960",
    TopBound="40.76496",
    BottomBound="40.76354",
    FilePath=file_path_41,
    RunToggle=True)  # -> OSMQueryURL, OSMFilePath
file_path_42 = FilePath(download_openstreetmap_osm_21.OSMFilePath)
panel_42 = Panel(download_openstreetmap_osm_21.OSMQueryURL)

# ----
# 70- 50th St & Hudson river greenway
panel_43 = Panel("40.76752")
file_path_43 = FilePath("D:\MaCad\A.I and M.L\studio\Data Set for Prediction\70- 50th St & Hudson river greenway")
download_openstreetmap_osm_22 = DownloadOpenStreetMapOSM(
    LeftBound="-73.99863",
    RightBound="-73.99545",
    TopBound=panel_43,
    BottomBound="40.76610",
    FilePath=file_path_43,
    RunToggle=True)  # -> OSMQueryURL, OSMFilePath
file_path_44 = FilePath(download_openstreetmap_osm_22.OSMFilePath)
panel_44 = Panel(download_openstreetmap_osm_22.OSMQueryURL)

# ----
# 68- 50th St & Broadway
panel_45 = Panel("40.76211")
file_path_45 = FilePath("D:\MaCad\A.I and M.L\studio\Data Set for Prediction\68- 50th St & Broadway")
download_openstreetmap_osm_23 = DownloadOpenStreetMapOSM(
    LeftBound="-73.98557",
    RightBound="-73.98239",
    TopBound=panel_45,
    BottomBound="40.76069",
    FilePath=file_path_45,
    RunToggle=True)  # -> OSMQueryURL, OSMFilePath
file_path_46 = FilePath(download_openstreetmap_osm_23.OSMFilePath)
panel_46 = Panel(download_openstreetmap_osm_23.OSMQueryURL)

# ----
# 66- 50th St & 6Th Ave
panel_47 = Panel("-73.98183")
file_path_47 = FilePath("D:\MaCad\A.I and M.L\studio\Data Set for Prediction\67- 50th St & 6Th Ave")
download_openstreetmap_osm_24 = DownloadOpenStreetMapOSM(
    LeftBound=panel_47,
    RightBound="-73.97865",
    TopBound="40.76069",
    BottomBound="40.75927",
    FilePath=file_path_47,
    RunToggle=True)  # -> OSMQueryURL, OSMFilePath
file_path_48 = FilePath(download_openstreetmap_osm_24.OSMFilePath)
panel_48 = Panel(download_openstreetmap_osm_24.OSMQueryURL)

# ----
# 67- 50th St & 7Th Ave
panel_49 = Panel("-73.98476")
file_path_49 = FilePath("D:\MaCad\A.I and M.L\studio\Data Set for Prediction\67- 50th St & 7Th Ave")
download_openstreetmap_osm_25 = DownloadOpenStreetMapOSM(
    LeftBound=panel_49,
    RightBound="-73.98158",
    TopBound="40.76182",
    BottomBound="40.76040",
    FilePath=file_path_49,
    RunToggle=True)  # -> OSMQueryURL, OSMFilePath
file_path_50 = FilePath(download_openstreetmap_osm_25.OSMFilePath)
panel_50 = Panel(download_openstreetmap_osm_25.OSMQueryURL)

# ----
# OSM MODEL
import_osm_features = ImportOSMFeatures(OSMPathOrURL=file_path_2, OSMFeatureType="tourism", Format="xml", ImportAltitude=False)  # -> Points, Metadata, UTMZone, TranslationVector
import_osm_features_2 = ImportOSMFeatures(OSMPathOrURL=file_path_2, OSMFeatureType="public_transport", Format="xml", ImportAltitude=False)  # -> Points, Metadata, UTMZone, TranslationVector
import_osm_features_3 = ImportOSMFeatures(OSMPathOrURL=file_path_2, OSMFeatureType="building", Format="xml", ImportAltitude=False)  # -> Points, Metadata, UTMZone, TranslationVector
import_osm_features_4 = ImportOSMFeatures(OSMPathOrURL=file_path_2, OSMFeatureType="amenity", Format="xml", ImportAltitude=False)  # -> Points, Metadata, UTMZone, TranslationVector
import_osm_features_5 = ImportOSMFeatures(
    OSMPathOrURL=file_path_2,
    OSMFeatureType="street",
    Format="xml",
    UTMZone=import_osm_features_3.UTMZone,
    TranslationVector=import_osm_features_3.TranslationVector,
    ImportAltitude=False)  # -> Points, Metadata, UTMZone, TranslationVector
polyline = PolyLine(Vertices=import_osm_features_5.Points, Closed=False)
polyline_2 = PolyLine(Vertices=import_osm_features_3.Points, Closed=False)
panel_51 = Panel(import_osm_features_2.Points)
panel_52 = Panel(import_osm_features.Points)
create_street_network = CreateStreetNetwork(
    StreetCurves=flatten(polyline),
    Metadata=flatten(import_osm_features_5.Metadata),
    SplitStreetCurves=False,
    UTMZone=import_osm_features_5.UTMZone,
    TranslationVector=import_osm_features_5.TranslationVector)  # -> StreetNetwork, StreetSegmentCurves, UTMZone, TranslationVector
create_amenity = CreateAmenity(PointLocationOfAmenity=import_osm_features_4.Points, Metadata=import_osm_features_4.Metadata)
arrange_amenities_by_building = ArrangeAmenitiesByBuilding(Amenities=flatten(create_amenity), Buildings=flatten(polyline_2))  # -> AmenitiesByBuilding, Buildings
list_length = ListLength(List=flatten(panel_51))
list_length_2 = ListLength(List=flatten(panel_52))
create_building = CreateBuilding(
    BuildingCurve=polyline_2,
    Metadata=import_osm_features_3.Metadata,
    AmenitiesInBuilding=arrange_amenities_by_building.AmenitiesByBuilding)

# ----
# OSM MODEL
import_osm_features_6 = ImportOSMFeatures(OSMPathOrURL=file_path_4, OSMFeatureType="tourism", Format="xml", ImportAltitude=False)  # -> Points, Metadata, UTMZone, TranslationVector
import_osm_features_7 = ImportOSMFeatures(OSMPathOrURL=file_path_4, OSMFeatureType="public_transport", Format="xml", ImportAltitude=False)  # -> Points, Metadata, UTMZone, TranslationVector
import_osm_features_8 = ImportOSMFeatures(OSMPathOrURL=file_path_4, OSMFeatureType="building", Format="xml", ImportAltitude=False)  # -> Points, Metadata, UTMZone, TranslationVector
import_osm_features_9 = ImportOSMFeatures(OSMPathOrURL=file_path_4, OSMFeatureType="amenity", Format="xml", ImportAltitude=False)  # -> Points, Metadata, UTMZone, TranslationVector
import_osm_features_10 = ImportOSMFeatures(
    OSMPathOrURL=file_path_4,
    OSMFeatureType="street",
    Format="xml",
    UTMZone=import_osm_features_8.UTMZone,
    TranslationVector=import_osm_features_8.TranslationVector,
    ImportAltitude=False)  # -> Points, Metadata, UTMZone, TranslationVector
polyline_3 = PolyLine(Vertices=import_osm_features_10.Points, Closed=False)
polyline_4 = PolyLine(Vertices=import_osm_features_8.Points, Closed=False)
panel_53 = Panel(import_osm_features_7.Points)
panel_54 = Panel(import_osm_features_6.Points)
create_street_network_2 = CreateStreetNetwork(
    StreetCurves=flatten(polyline_3),
    Metadata=flatten(import_osm_features_10.Metadata),
    SplitStreetCurves=False,
    UTMZone=import_osm_features_10.UTMZone,
    TranslationVector=import_osm_features_10.TranslationVector)  # -> StreetNetwork, StreetSegmentCurves, UTMZone, TranslationVector
create_amenity_2 = CreateAmenity(PointLocationOfAmenity=import_osm_features_9.Points, Metadata=import_osm_features_9.Metadata)
arrange_amenities_by_building_2 = ArrangeAmenitiesByBuilding(Amenities=flatten(create_amenity_2), Buildings=flatten(polyline_4))  # -> AmenitiesByBuilding, Buildings
list_length_3 = ListLength(List=flatten(panel_53))
list_length_4 = ListLength(List=flatten(panel_54))
create_building_2 = CreateBuilding(
    BuildingCurve=polyline_4,
    Metadata=import_osm_features_8.Metadata,
    AmenitiesInBuilding=arrange_amenities_by_building_2.AmenitiesByBuilding)

# ----
# OSM MODEL
import_osm_features_11 = ImportOSMFeatures(OSMPathOrURL=file_path_6, OSMFeatureType="tourism", Format="xml", ImportAltitude=False)  # -> Points, Metadata, UTMZone, TranslationVector
import_osm_features_12 = ImportOSMFeatures(OSMPathOrURL=file_path_6, OSMFeatureType="public_transport", Format="xml", ImportAltitude=False)  # -> Points, Metadata, UTMZone, TranslationVector
import_osm_features_13 = ImportOSMFeatures(OSMPathOrURL=file_path_6, OSMFeatureType="building", Format="xml", ImportAltitude=False)  # -> Points, Metadata, UTMZone, TranslationVector
import_osm_features_14 = ImportOSMFeatures(OSMPathOrURL=file_path_6, OSMFeatureType="amenity", Format="xml", ImportAltitude=False)  # -> Points, Metadata, UTMZone, TranslationVector
import_osm_features_15 = ImportOSMFeatures(
    OSMPathOrURL=file_path_6,
    OSMFeatureType="street",
    Format="xml",
    UTMZone=import_osm_features_13.UTMZone,
    TranslationVector=import_osm_features_13.TranslationVector,
    ImportAltitude=False)  # -> Points, Metadata, UTMZone, TranslationVector
polyline_5 = PolyLine(Vertices=import_osm_features_15.Points, Closed=False)
polyline_6 = PolyLine(Vertices=import_osm_features_13.Points, Closed=False)
panel_55 = Panel(import_osm_features_12.Points)
panel_56 = Panel(import_osm_features_11.Points)
create_street_network_3 = CreateStreetNetwork(
    StreetCurves=flatten(polyline_5),
    Metadata=flatten(import_osm_features_15.Metadata),
    SplitStreetCurves=False,
    UTMZone=import_osm_features_15.UTMZone,
    TranslationVector=import_osm_features_15.TranslationVector)  # -> StreetNetwork, StreetSegmentCurves, UTMZone, TranslationVector
create_amenity_3 = CreateAmenity(PointLocationOfAmenity=import_osm_features_14.Points, Metadata=import_osm_features_14.Metadata)
arrange_amenities_by_building_3 = ArrangeAmenitiesByBuilding(Amenities=flatten(create_amenity_3), Buildings=flatten(polyline_6))  # -> AmenitiesByBuilding, Buildings
list_length_5 = ListLength(List=flatten(panel_55))
list_length_6 = ListLength(List=flatten(panel_56))
create_building_3 = CreateBuilding(
    BuildingCurve=polyline_6,
    Metadata=import_osm_features_13.Metadata,
    AmenitiesInBuilding=arrange_amenities_by_building_3.AmenitiesByBuilding)

# ----
# OSM MODEL
import_osm_features_16 = ImportOSMFeatures(OSMPathOrURL=file_path_8, OSMFeatureType="tourism", Format="xml", ImportAltitude=False)  # -> Points, Metadata, UTMZone, TranslationVector
import_osm_features_17 = ImportOSMFeatures(OSMPathOrURL=file_path_8, OSMFeatureType="public_transport", Format="xml", ImportAltitude=False)  # -> Points, Metadata, UTMZone, TranslationVector
import_osm_features_18 = ImportOSMFeatures(OSMPathOrURL=file_path_8, OSMFeatureType="building", Format="xml", ImportAltitude=False)  # -> Points, Metadata, UTMZone, TranslationVector
import_osm_features_19 = ImportOSMFeatures(OSMPathOrURL=file_path_8, OSMFeatureType="amenity", Format="xml", ImportAltitude=False)  # -> Points, Metadata, UTMZone, TranslationVector
import_osm_features_20 = ImportOSMFeatures(
    OSMPathOrURL=file_path_8,
    OSMFeatureType="street",
    Format="xml",
    UTMZone=import_osm_features_18.UTMZone,
    TranslationVector=import_osm_features_18.TranslationVector,
    ImportAltitude=False)  # -> Points, Metadata, UTMZone, TranslationVector
polyline_7 = PolyLine(Vertices=import_osm_features_20.Points, Closed=False)
polyline_8 = PolyLine(Vertices=import_osm_features_18.Points, Closed=False)
panel_57 = Panel(import_osm_features_17.Points)
panel_58 = Panel(import_osm_features_16.Points)
create_street_network_4 = CreateStreetNetwork(
    StreetCurves=flatten(polyline_7),
    Metadata=flatten(import_osm_features_20.Metadata),
    SplitStreetCurves=False,
    UTMZone=import_osm_features_20.UTMZone,
    TranslationVector=import_osm_features_20.TranslationVector)  # -> StreetNetwork, StreetSegmentCurves, UTMZone, TranslationVector
create_amenity_4 = CreateAmenity(PointLocationOfAmenity=import_osm_features_19.Points, Metadata=import_osm_features_19.Metadata)
arrange_amenities_by_building_4 = ArrangeAmenitiesByBuilding(Amenities=flatten(create_amenity_4), Buildings=flatten(polyline_8))  # -> AmenitiesByBuilding, Buildings
list_length_7 = ListLength(List=flatten(panel_57))
list_length_8 = ListLength(List=flatten(panel_58))
create_building_4 = CreateBuilding(
    BuildingCurve=polyline_8,
    Metadata=import_osm_features_18.Metadata,
    AmenitiesInBuilding=arrange_amenities_by_building_4.AmenitiesByBuilding)

# ----
# OSM MODEL
import_osm_features_21 = ImportOSMFeatures(OSMPathOrURL=file_path_14, OSMFeatureType="tourism", Format="xml", ImportAltitude=False)  # -> Points, Metadata, UTMZone, TranslationVector
import_osm_features_22 = ImportOSMFeatures(OSMPathOrURL=file_path_14, OSMFeatureType="public_transport", Format="xml", ImportAltitude=False)  # -> Points, Metadata, UTMZone, TranslationVector
import_osm_features_23 = ImportOSMFeatures(OSMPathOrURL=file_path_14, OSMFeatureType="building", Format="xml", ImportAltitude=False)  # -> Points, Metadata, UTMZone, TranslationVector
import_osm_features_24 = ImportOSMFeatures(OSMPathOrURL=file_path_14, OSMFeatureType="amenity", Format="xml", ImportAltitude=False)  # -> Points, Metadata, UTMZone, TranslationVector
import_osm_features_25 = ImportOSMFeatures(
    OSMPathOrURL=file_path_14,
    OSMFeatureType="street",
    Format="xml",
    UTMZone=import_osm_features_23.UTMZone,
    TranslationVector=import_osm_features_23.TranslationVector,
    ImportAltitude=False)  # -> Points, Metadata, UTMZone, TranslationVector
polyline_9 = PolyLine(Vertices=import_osm_features_25.Points, Closed=False)
polyline_10 = PolyLine(Vertices=import_osm_features_23.Points, Closed=False)
create_street_network_5 = CreateStreetNetwork(
    StreetCurves=flatten(polyline_9),
    Metadata=flatten(import_osm_features_25.Metadata),
    SplitStreetCurves=False,
    UTMZone=import_osm_features_25.UTMZone,
    TranslationVector=import_osm_features_25.TranslationVector)  # -> StreetNetwork, StreetSegmentCurves, UTMZone, TranslationVector
create_amenity_5 = CreateAmenity(PointLocationOfAmenity=import_osm_features_24.Points, Metadata=import_osm_features_24.Metadata)
panel_59 = Panel(import_osm_features_22.Points)
panel_60 = Panel(import_osm_features_21.Points)
arrange_amenities_by_building_5 = ArrangeAmenitiesByBuilding(Amenities=flatten(create_amenity_5), Buildings=flatten(polyline_10))  # -> AmenitiesByBuilding, Buildings
list_length_9 = ListLength(List=flatten(panel_59))
list_length_10 = ListLength(List=flatten(panel_60))
create_building_5 = CreateBuilding(
    BuildingCurve=polyline_10,
    Metadata=import_osm_features_23.Metadata,
    AmenitiesInBuilding=arrange_amenities_by_building_5.AmenitiesByBuilding)

# ----
# OSM MODEL
import_osm_features_26 = ImportOSMFeatures(OSMPathOrURL=file_path_10, OSMFeatureType="tourism", Format="xml", ImportAltitude=False)  # -> Points, Metadata, UTMZone, TranslationVector
import_osm_features_27 = ImportOSMFeatures(OSMPathOrURL=file_path_10, OSMFeatureType="public_transport", Format="xml", ImportAltitude=False)  # -> Points, Metadata, UTMZone, TranslationVector
import_osm_features_28 = ImportOSMFeatures(OSMPathOrURL=file_path_10, OSMFeatureType="building", Format="xml", ImportAltitude=False)  # -> Points, Metadata, UTMZone, TranslationVector
import_osm_features_29 = ImportOSMFeatures(OSMPathOrURL=file_path_10, OSMFeatureType="amenity", Format="xml", ImportAltitude=False)  # -> Points, Metadata, UTMZone, TranslationVector
import_osm_features_30 = ImportOSMFeatures(
    OSMPathOrURL=file_path_10,
    OSMFeatureType="street",
    Format="xml",
    UTMZone=import_osm_features_28.UTMZone,
    TranslationVector=import_osm_features_28.TranslationVector,
    ImportAltitude=False)  # -> Points, Metadata, UTMZone, TranslationVector
polyline_11 = PolyLine(Vertices=import_osm_features_30.Points, Closed=False)
polyline_12 = PolyLine(Vertices=import_osm_features_28.Points, Closed=False)
panel_61 = Panel(import_osm_features_27.Points)
panel_62 = Panel(import_osm_features_26.Points)
create_street_network_6 = CreateStreetNetwork(
    StreetCurves=flatten(polyline_11),
    Metadata=flatten(import_osm_features_30.Metadata),
    SplitStreetCurves=False,
    UTMZone=import_osm_features_30.UTMZone,
    TranslationVector=import_osm_features_30.TranslationVector)  # -> StreetNetwork, StreetSegmentCurves, UTMZone, TranslationVector
create_amenity_6 = CreateAmenity(PointLocationOfAmenity=import_osm_features_29.Points, Metadata=import_osm_features_29.Metadata)
arrange_amenities_by_building_6 = ArrangeAmenitiesByBuilding(Amenities=flatten(create_amenity_6), Buildings=flatten(polyline_12))  # -> AmenitiesByBuilding, Buildings
list_length_11 = ListLength(List=flatten(panel_61))
list_length_12 = ListLength(List=flatten(panel_62))
create_building_6 = CreateBuilding(
    BuildingCurve=polyline_12,
    Metadata=import_osm_features_28.Metadata,
    AmenitiesInBuilding=arrange_amenities_by_building_6.AmenitiesByBuilding)

# ----
# OSM MODEL
import_osm_features_31 = ImportOSMFeatures(OSMPathOrURL=file_path_12, OSMFeatureType="tourism", Format="xml", ImportAltitude=False)  # -> Points, Metadata, UTMZone, TranslationVector
import_osm_features_32 = ImportOSMFeatures(OSMPathOrURL=file_path_12, OSMFeatureType="public_transport", Format="xml", ImportAltitude=False)  # -> Points, Metadata, UTMZone, TranslationVector
import_osm_features_33 = ImportOSMFeatures(OSMPathOrURL=file_path_12, OSMFeatureType="building", Format="xml", ImportAltitude=False)  # -> Points, Metadata, UTMZone, TranslationVector
import_osm_features_34 = ImportOSMFeatures(OSMPathOrURL=file_path_12, OSMFeatureType="amenity", Format="xml", ImportAltitude=False)  # -> Points, Metadata, UTMZone, TranslationVector
import_osm_features_35 = ImportOSMFeatures(
    OSMPathOrURL=file_path_12,
    OSMFeatureType="street",
    Format="xml",
    UTMZone=import_osm_features_33.UTMZone,
    TranslationVector=import_osm_features_33.TranslationVector,
    ImportAltitude=False)  # -> Points, Metadata, UTMZone, TranslationVector
polyline_13 = PolyLine(Vertices=import_osm_features_35.Points, Closed=False)
polyline_14 = PolyLine(Vertices=import_osm_features_33.Points, Closed=False)
panel_63 = Panel(import_osm_features_32.Points)
panel_64 = Panel(import_osm_features_31.Points)
create_street_network_7 = CreateStreetNetwork(
    StreetCurves=flatten(polyline_13),
    Metadata=flatten(import_osm_features_35.Metadata),
    SplitStreetCurves=False,
    UTMZone=import_osm_features_35.UTMZone,
    TranslationVector=import_osm_features_35.TranslationVector)  # -> StreetNetwork, StreetSegmentCurves, UTMZone, TranslationVector
create_amenity_7 = CreateAmenity(PointLocationOfAmenity=import_osm_features_34.Points, Metadata=import_osm_features_34.Metadata)
arrange_amenities_by_building_7 = ArrangeAmenitiesByBuilding(Amenities=flatten(create_amenity_7), Buildings=flatten(polyline_14))  # -> AmenitiesByBuilding, Buildings
list_length_13 = ListLength(List=flatten(panel_63))
list_length_14 = ListLength(List=flatten(panel_64))
create_building_7 = CreateBuilding(
    BuildingCurve=polyline_14,
    Metadata=import_osm_features_33.Metadata,
    AmenitiesInBuilding=arrange_amenities_by_building_7.AmenitiesByBuilding)

# ----
# OSM MODEL
import_osm_features_36 = ImportOSMFeatures(OSMPathOrURL=file_path_20, OSMFeatureType="tourism", Format="xml", ImportAltitude=False)  # -> Points, Metadata, UTMZone, TranslationVector
import_osm_features_37 = ImportOSMFeatures(OSMPathOrURL=file_path_20, OSMFeatureType="public_transport", Format="xml", ImportAltitude=False)  # -> Points, Metadata, UTMZone, TranslationVector
import_osm_features_38 = ImportOSMFeatures(OSMPathOrURL=file_path_20, OSMFeatureType="building", Format="xml", ImportAltitude=False)  # -> Points, Metadata, UTMZone, TranslationVector
import_osm_features_39 = ImportOSMFeatures(OSMPathOrURL=file_path_20, OSMFeatureType="amenity", Format="xml", ImportAltitude=False)  # -> Points, Metadata, UTMZone, TranslationVector
import_osm_features_40 = ImportOSMFeatures(
    OSMPathOrURL=file_path_20,
    OSMFeatureType="street",
    Format="xml",
    UTMZone=import_osm_features_38.UTMZone,
    TranslationVector=import_osm_features_38.TranslationVector,
    ImportAltitude=False)  # -> Points, Metadata, UTMZone, TranslationVector
polyline_15 = PolyLine(Vertices=import_osm_features_40.Points, Closed=False)
polyline_16 = PolyLine(Vertices=import_osm_features_38.Points, Closed=False)
create_street_network_8 = CreateStreetNetwork(
    StreetCurves=flatten(polyline_15),
    Metadata=flatten(import_osm_features_40.Metadata),
    SplitStreetCurves=False,
    UTMZone=import_osm_features_40.UTMZone,
    TranslationVector=import_osm_features_40.TranslationVector)  # -> StreetNetwork, StreetSegmentCurves, UTMZone, TranslationVector
create_amenity_8 = CreateAmenity(PointLocationOfAmenity=import_osm_features_39.Points, Metadata=import_osm_features_39.Metadata)
panel_65 = Panel(import_osm_features_37.Points)
panel_66 = Panel(import_osm_features_36.Points)
arrange_amenities_by_building_8 = ArrangeAmenitiesByBuilding(Amenities=flatten(create_amenity_8), Buildings=flatten(polyline_16))  # -> AmenitiesByBuilding, Buildings
list_length_15 = ListLength(List=flatten(panel_65))
list_length_16 = ListLength(List=flatten(panel_66))
create_building_8 = CreateBuilding(
    BuildingCurve=polyline_16,
    Metadata=import_osm_features_38.Metadata,
    AmenitiesInBuilding=arrange_amenities_by_building_8.AmenitiesByBuilding)

# ----
# OSM MODEL
import_osm_features_41 = ImportOSMFeatures(OSMPathOrURL=file_path_22, OSMFeatureType="tourism", Format="xml", ImportAltitude=False)  # -> Points, Metadata, UTMZone, TranslationVector
import_osm_features_42 = ImportOSMFeatures(OSMPathOrURL=file_path_22, OSMFeatureType="public_transport", Format="xml", ImportAltitude=False)  # -> Points, Metadata, UTMZone, TranslationVector
import_osm_features_43 = ImportOSMFeatures(OSMPathOrURL=file_path_22, OSMFeatureType="building", Format="xml", ImportAltitude=False)  # -> Points, Metadata, UTMZone, TranslationVector
import_osm_features_44 = ImportOSMFeatures(OSMPathOrURL=file_path_22, OSMFeatureType="amenity", Format="xml", ImportAltitude=False)  # -> Points, Metadata, UTMZone, TranslationVector
import_osm_features_45 = ImportOSMFeatures(
    OSMPathOrURL=file_path_22,
    OSMFeatureType="street",
    Format="xml",
    UTMZone=import_osm_features_43.UTMZone,
    TranslationVector=import_osm_features_43.TranslationVector,
    ImportAltitude=False)  # -> Points, Metadata, UTMZone, TranslationVector
polyline_17 = PolyLine(Vertices=import_osm_features_45.Points, Closed=False)
polyline_18 = PolyLine(Vertices=import_osm_features_43.Points, Closed=False)
create_street_network_9 = CreateStreetNetwork(
    StreetCurves=flatten(polyline_17),
    Metadata=flatten(import_osm_features_45.Metadata),
    SplitStreetCurves=False,
    UTMZone=import_osm_features_45.UTMZone,
    TranslationVector=import_osm_features_45.TranslationVector)  # -> StreetNetwork, StreetSegmentCurves, UTMZone, TranslationVector
create_amenity_9 = CreateAmenity(PointLocationOfAmenity=import_osm_features_44.Points, Metadata=import_osm_features_44.Metadata)
panel_67 = Panel(import_osm_features_42.Points)
panel_68 = Panel(import_osm_features_41.Points)
arrange_amenities_by_building_9 = ArrangeAmenitiesByBuilding(Amenities=flatten(create_amenity_9), Buildings=flatten(polyline_18))  # -> AmenitiesByBuilding, Buildings
list_length_17 = ListLength(List=flatten(panel_67))
list_length_18 = ListLength(List=flatten(panel_68))
create_building_9 = CreateBuilding(
    BuildingCurve=polyline_18,
    Metadata=import_osm_features_43.Metadata,
    AmenitiesInBuilding=arrange_amenities_by_building_9.AmenitiesByBuilding)

# ----
# OSM MODEL
import_osm_features_46 = ImportOSMFeatures(OSMPathOrURL=file_path_16, OSMFeatureType="tourism", Format="xml", ImportAltitude=False)  # -> Points, Metadata, UTMZone, TranslationVector
import_osm_features_47 = ImportOSMFeatures(OSMPathOrURL=file_path_16, OSMFeatureType="public_transport", Format="xml", ImportAltitude=False)  # -> Points, Metadata, UTMZone, TranslationVector
import_osm_features_48 = ImportOSMFeatures(OSMPathOrURL=file_path_16, OSMFeatureType="building", Format="xml", ImportAltitude=False)  # -> Points, Metadata, UTMZone, TranslationVector
import_osm_features_49 = ImportOSMFeatures(OSMPathOrURL=file_path_16, OSMFeatureType="amenity", Format="xml", ImportAltitude=False)  # -> Points, Metadata, UTMZone, TranslationVector
import_osm_features_50 = ImportOSMFeatures(
    OSMPathOrURL=file_path_16,
    OSMFeatureType="street",
    Format="xml",
    UTMZone=import_osm_features_48.UTMZone,
    TranslationVector=import_osm_features_48.TranslationVector,
    ImportAltitude=False)  # -> Points, Metadata, UTMZone, TranslationVector
polyline_19 = PolyLine(Vertices=import_osm_features_50.Points, Closed=False)
polyline_20 = PolyLine(Vertices=import_osm_features_48.Points, Closed=False)
panel_69 = Panel(import_osm_features_47.Points)
panel_70 = Panel(import_osm_features_46.Points)
create_street_network_10 = CreateStreetNetwork(
    StreetCurves=flatten(polyline_19),
    Metadata=flatten(import_osm_features_50.Metadata),
    SplitStreetCurves=False,
    UTMZone=import_osm_features_50.UTMZone,
    TranslationVector=import_osm_features_50.TranslationVector)  # -> StreetNetwork, StreetSegmentCurves, UTMZone, TranslationVector
create_amenity_10 = CreateAmenity(PointLocationOfAmenity=import_osm_features_49.Points, Metadata=import_osm_features_49.Metadata)
arrange_amenities_by_building_10 = ArrangeAmenitiesByBuilding(Amenities=flatten(create_amenity_10), Buildings=flatten(polyline_20))  # -> AmenitiesByBuilding, Buildings
list_length_19 = ListLength(List=flatten(panel_69))
list_length_20 = ListLength(List=flatten(panel_70))
create_building_10 = CreateBuilding(
    BuildingCurve=polyline_20,
    Metadata=import_osm_features_48.Metadata,
    AmenitiesInBuilding=arrange_amenities_by_building_10.AmenitiesByBuilding)

# ----
# OSM MODEL
import_osm_features_51 = ImportOSMFeatures(OSMPathOrURL=file_path_18, OSMFeatureType="tourism", Format="xml", ImportAltitude=False)  # -> Points, Metadata, UTMZone, TranslationVector
import_osm_features_52 = ImportOSMFeatures(OSMPathOrURL=file_path_18, OSMFeatureType="public_transport", Format="xml", ImportAltitude=False)  # -> Points, Metadata, UTMZone, TranslationVector
import_osm_features_53 = ImportOSMFeatures(OSMPathOrURL=file_path_18, OSMFeatureType="building", Format="xml", ImportAltitude=False)  # -> Points, Metadata, UTMZone, TranslationVector
import_osm_features_54 = ImportOSMFeatures(OSMPathOrURL=file_path_18, OSMFeatureType="amenity", Format="xml", ImportAltitude=False)  # -> Points, Metadata, UTMZone, TranslationVector
import_osm_features_55 = ImportOSMFeatures(
    OSMPathOrURL=file_path_18,
    OSMFeatureType="street",
    Format="xml",
    UTMZone=import_osm_features_53.UTMZone,
    TranslationVector=import_osm_features_53.TranslationVector,
    ImportAltitude=False)  # -> Points, Metadata, UTMZone, TranslationVector
polyline_21 = PolyLine(Vertices=import_osm_features_55.Points, Closed=False)
polyline_22 = PolyLine(Vertices=import_osm_features_53.Points, Closed=False)
panel_71 = Panel(import_osm_features_52.Points)
panel_72 = Panel(import_osm_features_51.Points)
create_street_network_11 = CreateStreetNetwork(
    StreetCurves=flatten(polyline_21),
    Metadata=flatten(import_osm_features_55.Metadata),
    SplitStreetCurves=False,
    UTMZone=import_osm_features_55.UTMZone,
    TranslationVector=import_osm_features_55.TranslationVector)  # -> StreetNetwork, StreetSegmentCurves, UTMZone, TranslationVector
create_amenity_11 = CreateAmenity(PointLocationOfAmenity=import_osm_features_54.Points, Metadata=import_osm_features_54.Metadata)
arrange_amenities_by_building_11 = ArrangeAmenitiesByBuilding(Amenities=flatten(create_amenity_11), Buildings=flatten(polyline_22))  # -> AmenitiesByBuilding, Buildings
list_length_21 = ListLength(List=flatten(panel_71))
list_length_22 = ListLength(List=flatten(panel_72))
create_building_11 = CreateBuilding(
    BuildingCurve=polyline_22,
    Metadata=import_osm_features_53.Metadata,
    AmenitiesInBuilding=arrange_amenities_by_building_11.AmenitiesByBuilding)

# ----
# OSM MODEL
import_osm_features_56 = ImportOSMFeatures(OSMPathOrURL=file_path_26, OSMFeatureType="tourism", Format="xml", ImportAltitude=False)  # -> Points, Metadata, UTMZone, TranslationVector
import_osm_features_57 = ImportOSMFeatures(OSMPathOrURL=file_path_26, OSMFeatureType="public_transport", Format="xml", ImportAltitude=False)  # -> Points, Metadata, UTMZone, TranslationVector
import_osm_features_58 = ImportOSMFeatures(OSMPathOrURL=file_path_26, OSMFeatureType="building", Format="xml", ImportAltitude=False)  # -> Points, Metadata, UTMZone, TranslationVector
import_osm_features_59 = ImportOSMFeatures(OSMPathOrURL=file_path_26, OSMFeatureType="amenity", Format="xml", ImportAltitude=False)  # -> Points, Metadata, UTMZone, TranslationVector
import_osm_features_60 = ImportOSMFeatures(
    OSMPathOrURL=file_path_26,
    OSMFeatureType="street",
    Format="xml",
    UTMZone=import_osm_features_58.UTMZone,
    TranslationVector=import_osm_features_58.TranslationVector,
    ImportAltitude=False)  # -> Points, Metadata, UTMZone, TranslationVector
polyline_23 = PolyLine(Vertices=import_osm_features_60.Points, Closed=False)
polyline_24 = PolyLine(Vertices=import_osm_features_58.Points, Closed=False)
create_street_network_12 = CreateStreetNetwork(
    StreetCurves=flatten(polyline_23),
    Metadata=flatten(import_osm_features_60.Metadata),
    SplitStreetCurves=False,
    UTMZone=import_osm_features_60.UTMZone,
    TranslationVector=import_osm_features_60.TranslationVector)  # -> StreetNetwork, StreetSegmentCurves, UTMZone, TranslationVector
create_amenity_12 = CreateAmenity(PointLocationOfAmenity=import_osm_features_59.Points, Metadata=import_osm_features_59.Metadata)
panel_73 = Panel(import_osm_features_57.Points)
panel_74 = Panel(import_osm_features_56.Points)
arrange_amenities_by_building_12 = ArrangeAmenitiesByBuilding(Amenities=flatten(create_amenity_12), Buildings=flatten(polyline_24))  # -> AmenitiesByBuilding, Buildings
list_length_23 = ListLength(List=flatten(panel_73))
list_length_24 = ListLength(List=flatten(panel_74))
create_building_12 = CreateBuilding(
    BuildingCurve=polyline_24,
    Metadata=import_osm_features_58.Metadata,
    AmenitiesInBuilding=arrange_amenities_by_building_12.AmenitiesByBuilding)

# ----
# OSM MODEL
import_osm_features_61 = ImportOSMFeatures(OSMPathOrURL=file_path_24, OSMFeatureType="tourism", Format="xml", ImportAltitude=False)  # -> Points, Metadata, UTMZone, TranslationVector
import_osm_features_62 = ImportOSMFeatures(OSMPathOrURL=file_path_24, OSMFeatureType="public_transport", Format="xml", ImportAltitude=False)  # -> Points, Metadata, UTMZone, TranslationVector
import_osm_features_63 = ImportOSMFeatures(OSMPathOrURL=file_path_24, OSMFeatureType="building", Format="xml", ImportAltitude=False)  # -> Points, Metadata, UTMZone, TranslationVector
import_osm_features_64 = ImportOSMFeatures(OSMPathOrURL=file_path_24, OSMFeatureType="amenity", Format="xml", ImportAltitude=False)  # -> Points, Metadata, UTMZone, TranslationVector
import_osm_features_65 = ImportOSMFeatures(
    OSMPathOrURL=file_path_24,
    OSMFeatureType="street",
    Format="xml",
    UTMZone=import_osm_features_63.UTMZone,
    TranslationVector=import_osm_features_63.TranslationVector,
    ImportAltitude=False)  # -> Points, Metadata, UTMZone, TranslationVector
polyline_25 = PolyLine(Vertices=import_osm_features_65.Points, Closed=False)
polyline_26 = PolyLine(Vertices=import_osm_features_63.Points, Closed=False)
create_street_network_13 = CreateStreetNetwork(
    StreetCurves=flatten(polyline_25),
    Metadata=flatten(import_osm_features_65.Metadata),
    SplitStreetCurves=False,
    UTMZone=import_osm_features_65.UTMZone,
    TranslationVector=import_osm_features_65.TranslationVector)  # -> StreetNetwork, StreetSegmentCurves, UTMZone, TranslationVector
create_amenity_13 = CreateAmenity(PointLocationOfAmenity=import_osm_features_64.Points, Metadata=import_osm_features_64.Metadata)
panel_75 = Panel(import_osm_features_62.Points)
panel_76 = Panel(import_osm_features_61.Points)
arrange_amenities_by_building_13 = ArrangeAmenitiesByBuilding(Amenities=flatten(create_amenity_13), Buildings=flatten(polyline_26))  # -> AmenitiesByBuilding, Buildings
list_length_25 = ListLength(List=flatten(panel_75))
list_length_26 = ListLength(List=flatten(panel_76))
create_building_13 = CreateBuilding(
    BuildingCurve=polyline_26,
    Metadata=import_osm_features_63.Metadata,
    AmenitiesInBuilding=arrange_amenities_by_building_13.AmenitiesByBuilding)

# ----
# OSM MODEL
import_osm_features_66 = ImportOSMFeatures(OSMPathOrURL=file_path_28, OSMFeatureType="tourism", Format="xml", ImportAltitude=False)  # -> Points, Metadata, UTMZone, TranslationVector
import_osm_features_67 = ImportOSMFeatures(OSMPathOrURL=file_path_28, OSMFeatureType="public_transport", Format="xml", ImportAltitude=False)  # -> Points, Metadata, UTMZone, TranslationVector
import_osm_features_68 = ImportOSMFeatures(OSMPathOrURL=file_path_28, OSMFeatureType="building", Format="xml", ImportAltitude=False)  # -> Points, Metadata, UTMZone, TranslationVector
import_osm_features_69 = ImportOSMFeatures(OSMPathOrURL=file_path_28, OSMFeatureType="amenity", Format="xml", ImportAltitude=False)  # -> Points, Metadata, UTMZone, TranslationVector
import_osm_features_70 = ImportOSMFeatures(
    OSMPathOrURL=file_path_28,
    OSMFeatureType="street",
    Format="xml",
    UTMZone=import_osm_features_68.UTMZone,
    TranslationVector=import_osm_features_68.TranslationVector,
    ImportAltitude=False)  # -> Points, Metadata, UTMZone, TranslationVector
polyline_27 = PolyLine(Vertices=import_osm_features_70.Points, Closed=False)
polyline_28 = PolyLine(Vertices=import_osm_features_68.Points, Closed=False)
create_street_network_14 = CreateStreetNetwork(
    StreetCurves=flatten(polyline_27),
    Metadata=flatten(import_osm_features_70.Metadata),
    SplitStreetCurves=False,
    UTMZone=import_osm_features_70.UTMZone,
    TranslationVector=import_osm_features_70.TranslationVector)  # -> StreetNetwork, StreetSegmentCurves, UTMZone, TranslationVector
create_amenity_14 = CreateAmenity(PointLocationOfAmenity=import_osm_features_69.Points, Metadata=import_osm_features_69.Metadata)
panel_77 = Panel(import_osm_features_67.Points)
panel_78 = Panel(import_osm_features_66.Points)
arrange_amenities_by_building_14 = ArrangeAmenitiesByBuilding(Amenities=flatten(create_amenity_14), Buildings=flatten(polyline_28))  # -> AmenitiesByBuilding, Buildings
list_length_27 = ListLength(List=flatten(panel_77))
list_length_28 = ListLength(List=flatten(panel_78))
create_building_14 = CreateBuilding(
    BuildingCurve=polyline_28,
    Metadata=import_osm_features_68.Metadata,
    AmenitiesInBuilding=arrange_amenities_by_building_14.AmenitiesByBuilding)

# ----
# OSM MODEL
import_osm_features_71 = ImportOSMFeatures(OSMPathOrURL=file_path_32, OSMFeatureType="tourism", Format="xml", ImportAltitude=False)  # -> Points, Metadata, UTMZone, TranslationVector
import_osm_features_72 = ImportOSMFeatures(OSMPathOrURL=file_path_32, OSMFeatureType="public_transport", Format="xml", ImportAltitude=False)  # -> Points, Metadata, UTMZone, TranslationVector
import_osm_features_73 = ImportOSMFeatures(OSMPathOrURL=file_path_32, OSMFeatureType="building", Format="xml", ImportAltitude=False)  # -> Points, Metadata, UTMZone, TranslationVector
import_osm_features_74 = ImportOSMFeatures(OSMPathOrURL=file_path_32, OSMFeatureType="amenity", Format="xml", ImportAltitude=False)  # -> Points, Metadata, UTMZone, TranslationVector
import_osm_features_75 = ImportOSMFeatures(
    OSMPathOrURL=file_path_32,
    OSMFeatureType="street",
    Format="xml",
    UTMZone=import_osm_features_73.UTMZone,
    TranslationVector=import_osm_features_73.TranslationVector,
    ImportAltitude=False)  # -> Points, Metadata, UTMZone, TranslationVector
polyline_29 = PolyLine(Vertices=import_osm_features_75.Points, Closed=False)
polyline_30 = PolyLine(Vertices=import_osm_features_73.Points, Closed=False)
create_street_network_15 = CreateStreetNetwork(
    StreetCurves=flatten(polyline_29),
    Metadata=flatten(import_osm_features_75.Metadata),
    SplitStreetCurves=False,
    UTMZone=import_osm_features_75.UTMZone,
    TranslationVector=import_osm_features_75.TranslationVector)  # -> StreetNetwork, StreetSegmentCurves, UTMZone, TranslationVector
create_amenity_15 = CreateAmenity(PointLocationOfAmenity=import_osm_features_74.Points, Metadata=import_osm_features_74.Metadata)
panel_79 = Panel(import_osm_features_72.Points)
panel_80 = Panel(import_osm_features_71.Points)
arrange_amenities_by_building_15 = ArrangeAmenitiesByBuilding(Amenities=flatten(create_amenity_15), Buildings=flatten(polyline_30))  # -> AmenitiesByBuilding, Buildings
list_length_29 = ListLength(List=flatten(panel_79))
list_length_30 = ListLength(List=flatten(panel_80))
create_building_15 = CreateBuilding(
    BuildingCurve=polyline_30,
    Metadata=import_osm_features_73.Metadata,
    AmenitiesInBuilding=arrange_amenities_by_building_15.AmenitiesByBuilding)

# ----
# OSM MODEL
import_osm_features_76 = ImportOSMFeatures(OSMPathOrURL=file_path_30, OSMFeatureType="tourism", Format="xml", ImportAltitude=False)  # -> Points, Metadata, UTMZone, TranslationVector
import_osm_features_77 = ImportOSMFeatures(OSMPathOrURL=file_path_30, OSMFeatureType="public_transport", Format="xml", ImportAltitude=False)  # -> Points, Metadata, UTMZone, TranslationVector
import_osm_features_78 = ImportOSMFeatures(OSMPathOrURL=file_path_30, OSMFeatureType="building", Format="xml", ImportAltitude=False)  # -> Points, Metadata, UTMZone, TranslationVector
import_osm_features_79 = ImportOSMFeatures(OSMPathOrURL=file_path_30, OSMFeatureType="amenity", Format="xml", ImportAltitude=False)  # -> Points, Metadata, UTMZone, TranslationVector
import_osm_features_80 = ImportOSMFeatures(
    OSMPathOrURL=file_path_30,
    OSMFeatureType="street",
    Format="xml",
    UTMZone=import_osm_features_78.UTMZone,
    TranslationVector=import_osm_features_78.TranslationVector,
    ImportAltitude=False)  # -> Points, Metadata, UTMZone, TranslationVector
polyline_31 = PolyLine(Vertices=import_osm_features_80.Points, Closed=False)
polyline_32 = PolyLine(Vertices=import_osm_features_78.Points, Closed=False)
create_street_network_16 = CreateStreetNetwork(
    StreetCurves=flatten(polyline_31),
    Metadata=flatten(import_osm_features_80.Metadata),
    SplitStreetCurves=False,
    UTMZone=import_osm_features_80.UTMZone,
    TranslationVector=import_osm_features_80.TranslationVector)  # -> StreetNetwork, StreetSegmentCurves, UTMZone, TranslationVector
create_amenity_16 = CreateAmenity(PointLocationOfAmenity=import_osm_features_79.Points, Metadata=import_osm_features_79.Metadata)
panel_81 = Panel(import_osm_features_77.Points)
panel_82 = Panel(import_osm_features_76.Points)
arrange_amenities_by_building_16 = ArrangeAmenitiesByBuilding(Amenities=flatten(create_amenity_16), Buildings=flatten(polyline_32))  # -> AmenitiesByBuilding, Buildings
list_length_31 = ListLength(List=flatten(panel_81))
list_length_32 = ListLength(List=flatten(panel_82))
create_building_16 = CreateBuilding(
    BuildingCurve=polyline_32,
    Metadata=import_osm_features_78.Metadata,
    AmenitiesInBuilding=arrange_amenities_by_building_16.AmenitiesByBuilding)

# ----
# OSM MODEL
import_osm_features_81 = ImportOSMFeatures(OSMPathOrURL=file_path_34, OSMFeatureType="tourism", Format="xml", ImportAltitude=False)  # -> Points, Metadata, UTMZone, TranslationVector
import_osm_features_82 = ImportOSMFeatures(OSMPathOrURL=file_path_34, OSMFeatureType="public_transport", Format="xml", ImportAltitude=False)  # -> Points, Metadata, UTMZone, TranslationVector
import_osm_features_83 = ImportOSMFeatures(OSMPathOrURL=file_path_34, OSMFeatureType="building", Format="xml", ImportAltitude=False)  # -> Points, Metadata, UTMZone, TranslationVector
import_osm_features_84 = ImportOSMFeatures(OSMPathOrURL=file_path_34, OSMFeatureType="amenity", Format="xml", ImportAltitude=False)  # -> Points, Metadata, UTMZone, TranslationVector
import_osm_features_85 = ImportOSMFeatures(
    OSMPathOrURL=file_path_34,
    OSMFeatureType="street",
    Format="xml",
    UTMZone=import_osm_features_83.UTMZone,
    TranslationVector=import_osm_features_83.TranslationVector,
    ImportAltitude=False)  # -> Points, Metadata, UTMZone, TranslationVector
polyline_33 = PolyLine(Vertices=import_osm_features_85.Points, Closed=False)
polyline_34 = PolyLine(Vertices=import_osm_features_83.Points, Closed=False)
create_street_network_17 = CreateStreetNetwork(
    StreetCurves=flatten(polyline_33),
    Metadata=flatten(import_osm_features_85.Metadata),
    SplitStreetCurves=False,
    UTMZone=import_osm_features_85.UTMZone,
    TranslationVector=import_osm_features_85.TranslationVector)  # -> StreetNetwork, StreetSegmentCurves, UTMZone, TranslationVector
create_amenity_17 = CreateAmenity(PointLocationOfAmenity=import_osm_features_84.Points, Metadata=import_osm_features_84.Metadata)
panel_83 = Panel(import_osm_features_82.Points)
panel_84 = Panel(import_osm_features_81.Points)
arrange_amenities_by_building_17 = ArrangeAmenitiesByBuilding(Amenities=flatten(create_amenity_17), Buildings=flatten(polyline_34))  # -> AmenitiesByBuilding, Buildings
list_length_33 = ListLength(List=flatten(panel_83))
list_length_34 = ListLength(List=flatten(panel_84))
create_building_17 = CreateBuilding(
    BuildingCurve=polyline_34,
    Metadata=import_osm_features_83.Metadata,
    AmenitiesInBuilding=arrange_amenities_by_building_17.AmenitiesByBuilding)

# ----
# OSM MODEL
import_osm_features_86 = ImportOSMFeatures(OSMPathOrURL=file_path_42, OSMFeatureType="tourism", Format="xml", ImportAltitude=False)  # -> Points, Metadata, UTMZone, TranslationVector
import_osm_features_87 = ImportOSMFeatures(OSMPathOrURL=file_path_42, OSMFeatureType="public_transport", Format="xml", ImportAltitude=False)  # -> Points, Metadata, UTMZone, TranslationVector
import_osm_features_88 = ImportOSMFeatures(OSMPathOrURL=file_path_42, OSMFeatureType="building", Format="xml", ImportAltitude=False)  # -> Points, Metadata, UTMZone, TranslationVector
import_osm_features_89 = ImportOSMFeatures(OSMPathOrURL=file_path_42, OSMFeatureType="amenity", Format="xml", ImportAltitude=False)  # -> Points, Metadata, UTMZone, TranslationVector
import_osm_features_90 = ImportOSMFeatures(
    OSMPathOrURL=file_path_42,
    OSMFeatureType="street",
    Format="xml",
    UTMZone=import_osm_features_88.UTMZone,
    TranslationVector=import_osm_features_88.TranslationVector,
    ImportAltitude=False)  # -> Points, Metadata, UTMZone, TranslationVector
polyline_35 = PolyLine(Vertices=import_osm_features_90.Points, Closed=False)
polyline_36 = PolyLine(Vertices=import_osm_features_88.Points, Closed=False)
create_street_network_18 = CreateStreetNetwork(
    StreetCurves=flatten(polyline_35),
    Metadata=flatten(import_osm_features_90.Metadata),
    SplitStreetCurves=False,
    UTMZone=import_osm_features_90.UTMZone,
    TranslationVector=import_osm_features_90.TranslationVector)  # -> StreetNetwork, StreetSegmentCurves, UTMZone, TranslationVector
create_amenity_18 = CreateAmenity(PointLocationOfAmenity=import_osm_features_89.Points, Metadata=import_osm_features_89.Metadata)
panel_85 = Panel(import_osm_features_87.Points)
panel_86 = Panel(import_osm_features_86.Points)
arrange_amenities_by_building_18 = ArrangeAmenitiesByBuilding(Amenities=flatten(create_amenity_18), Buildings=flatten(polyline_36))  # -> AmenitiesByBuilding, Buildings
list_length_35 = ListLength(List=flatten(panel_85))
list_length_36 = ListLength(List=flatten(panel_86))
create_building_18 = CreateBuilding(
    BuildingCurve=polyline_36,
    Metadata=import_osm_features_88.Metadata,
    AmenitiesInBuilding=arrange_amenities_by_building_18.AmenitiesByBuilding)

# ----
# OSM MODEL
import_osm_features_91 = ImportOSMFeatures(OSMPathOrURL=file_path_36, OSMFeatureType="tourism", Format="xml", ImportAltitude=False)  # -> Points, Metadata, UTMZone, TranslationVector
import_osm_features_92 = ImportOSMFeatures(OSMPathOrURL=file_path_36, OSMFeatureType="public_transport", Format="xml", ImportAltitude=False)  # -> Points, Metadata, UTMZone, TranslationVector
import_osm_features_93 = ImportOSMFeatures(OSMPathOrURL=file_path_36, OSMFeatureType="building", Format="xml", ImportAltitude=False)  # -> Points, Metadata, UTMZone, TranslationVector
import_osm_features_94 = ImportOSMFeatures(OSMPathOrURL=file_path_36, OSMFeatureType="amenity", Format="xml", ImportAltitude=False)  # -> Points, Metadata, UTMZone, TranslationVector
import_osm_features_95 = ImportOSMFeatures(
    OSMPathOrURL=file_path_36,
    OSMFeatureType="street",
    Format="xml",
    UTMZone=import_osm_features_93.UTMZone,
    TranslationVector=import_osm_features_93.TranslationVector,
    ImportAltitude=False)  # -> Points, Metadata, UTMZone, TranslationVector
polyline_37 = PolyLine(Vertices=import_osm_features_95.Points, Closed=False)
polyline_38 = PolyLine(Vertices=import_osm_features_93.Points, Closed=False)
create_street_network_19 = CreateStreetNetwork(
    StreetCurves=flatten(polyline_37),
    Metadata=flatten(import_osm_features_95.Metadata),
    SplitStreetCurves=False,
    UTMZone=import_osm_features_95.UTMZone,
    TranslationVector=import_osm_features_95.TranslationVector)  # -> StreetNetwork, StreetSegmentCurves, UTMZone, TranslationVector
create_amenity_19 = CreateAmenity(PointLocationOfAmenity=import_osm_features_94.Points, Metadata=import_osm_features_94.Metadata)
panel_87 = Panel(import_osm_features_92.Points)
panel_88 = Panel(import_osm_features_91.Points)
arrange_amenities_by_building_19 = ArrangeAmenitiesByBuilding(Amenities=flatten(create_amenity_19), Buildings=flatten(polyline_38))  # -> AmenitiesByBuilding, Buildings
list_length_37 = ListLength(List=flatten(panel_87))
list_length_38 = ListLength(List=flatten(panel_88))
create_building_19 = CreateBuilding(
    BuildingCurve=polyline_38,
    Metadata=import_osm_features_93.Metadata,
    AmenitiesInBuilding=arrange_amenities_by_building_19.AmenitiesByBuilding)

# ----
# OSM MODEL
import_osm_features_96 = ImportOSMFeatures(OSMPathOrURL=file_path_38, OSMFeatureType="tourism", Format="xml", ImportAltitude=False)  # -> Points, Metadata, UTMZone, TranslationVector
import_osm_features_97 = ImportOSMFeatures(OSMPathOrURL=file_path_38, OSMFeatureType="public_transport", Format="xml", ImportAltitude=False)  # -> Points, Metadata, UTMZone, TranslationVector
import_osm_features_98 = ImportOSMFeatures(OSMPathOrURL=file_path_38, OSMFeatureType="building", Format="xml", ImportAltitude=False)  # -> Points, Metadata, UTMZone, TranslationVector
import_osm_features_99 = ImportOSMFeatures(OSMPathOrURL=file_path_38, OSMFeatureType="amenity", Format="xml", ImportAltitude=False)  # -> Points, Metadata, UTMZone, TranslationVector
import_osm_features_100 = ImportOSMFeatures(
    OSMPathOrURL=file_path_38,
    OSMFeatureType="street",
    Format="xml",
    UTMZone=import_osm_features_98.UTMZone,
    TranslationVector=import_osm_features_98.TranslationVector,
    ImportAltitude=False)  # -> Points, Metadata, UTMZone, TranslationVector
polyline_39 = PolyLine(Vertices=import_osm_features_100.Points, Closed=False)
polyline_40 = PolyLine(Vertices=import_osm_features_98.Points, Closed=False)
create_street_network_20 = CreateStreetNetwork(
    StreetCurves=flatten(polyline_39),
    Metadata=flatten(import_osm_features_100.Metadata),
    SplitStreetCurves=False,
    UTMZone=import_osm_features_100.UTMZone,
    TranslationVector=import_osm_features_100.TranslationVector)  # -> StreetNetwork, StreetSegmentCurves, UTMZone, TranslationVector
create_amenity_20 = CreateAmenity(PointLocationOfAmenity=import_osm_features_99.Points, Metadata=import_osm_features_99.Metadata)
panel_89 = Panel(import_osm_features_97.Points)
panel_90 = Panel(import_osm_features_96.Points)
arrange_amenities_by_building_20 = ArrangeAmenitiesByBuilding(Amenities=flatten(create_amenity_20), Buildings=flatten(polyline_40))  # -> AmenitiesByBuilding, Buildings
list_length_39 = ListLength(List=flatten(panel_89))
list_length_40 = ListLength(List=flatten(panel_90))
create_building_20 = CreateBuilding(
    BuildingCurve=polyline_40,
    Metadata=import_osm_features_98.Metadata,
    AmenitiesInBuilding=arrange_amenities_by_building_20.AmenitiesByBuilding)

# ----
# OSM MODEL
import_osm_features_101 = ImportOSMFeatures(OSMPathOrURL=file_path_40, OSMFeatureType="tourism", Format="xml", ImportAltitude=False)  # -> Points, Metadata, UTMZone, TranslationVector
import_osm_features_102 = ImportOSMFeatures(OSMPathOrURL=file_path_40, OSMFeatureType="public_transport", Format="xml", ImportAltitude=False)  # -> Points, Metadata, UTMZone, TranslationVector
import_osm_features_103 = ImportOSMFeatures(OSMPathOrURL=file_path_40, OSMFeatureType="building", Format="xml", ImportAltitude=False)  # -> Points, Metadata, UTMZone, TranslationVector
import_osm_features_104 = ImportOSMFeatures(OSMPathOrURL=file_path_40, OSMFeatureType="amenity", Format="xml", ImportAltitude=False)  # -> Points, Metadata, UTMZone, TranslationVector
import_osm_features_105 = ImportOSMFeatures(
    OSMPathOrURL=file_path_40,
    OSMFeatureType="street",
    Format="xml",
    UTMZone=import_osm_features_103.UTMZone,
    TranslationVector=import_osm_features_103.TranslationVector,
    ImportAltitude=False)  # -> Points, Metadata, UTMZone, TranslationVector
polyline_41 = PolyLine(Vertices=import_osm_features_105.Points, Closed=False)
polyline_42 = PolyLine(Vertices=import_osm_features_103.Points, Closed=False)
create_street_network_21 = CreateStreetNetwork(
    StreetCurves=flatten(polyline_41),
    Metadata=flatten(import_osm_features_105.Metadata),
    SplitStreetCurves=False,
    UTMZone=import_osm_features_105.UTMZone,
    TranslationVector=import_osm_features_105.TranslationVector)  # -> StreetNetwork, StreetSegmentCurves, UTMZone, TranslationVector
create_amenity_21 = CreateAmenity(PointLocationOfAmenity=import_osm_features_104.Points, Metadata=import_osm_features_104.Metadata)
panel_91 = Panel(import_osm_features_102.Points)
panel_92 = Panel(import_osm_features_101.Points)
arrange_amenities_by_building_21 = ArrangeAmenitiesByBuilding(Amenities=flatten(create_amenity_21), Buildings=flatten(polyline_42))  # -> AmenitiesByBuilding, Buildings
list_length_41 = ListLength(List=flatten(panel_91))
list_length_42 = ListLength(List=flatten(panel_92))
create_building_21 = CreateBuilding(
    BuildingCurve=polyline_42,
    Metadata=import_osm_features_103.Metadata,
    AmenitiesInBuilding=arrange_amenities_by_building_21.AmenitiesByBuilding)

# ----
# OSM MODEL
import_osm_features_106 = ImportOSMFeatures(OSMPathOrURL=file_path_44, OSMFeatureType="tourism", Format="xml", ImportAltitude=False)  # -> Points, Metadata, UTMZone, TranslationVector
import_osm_features_107 = ImportOSMFeatures(OSMPathOrURL=file_path_44, OSMFeatureType="public_transport", Format="xml", ImportAltitude=False)  # -> Points, Metadata, UTMZone, TranslationVector
import_osm_features_108 = ImportOSMFeatures(OSMPathOrURL=file_path_44, OSMFeatureType="building", Format="xml", ImportAltitude=False)  # -> Points, Metadata, UTMZone, TranslationVector
import_osm_features_109 = ImportOSMFeatures(OSMPathOrURL=file_path_44, OSMFeatureType="amenity", Format="xml", ImportAltitude=False)  # -> Points, Metadata, UTMZone, TranslationVector
import_osm_features_110 = ImportOSMFeatures(
    OSMPathOrURL=file_path_44,
    OSMFeatureType="street",
    Format="xml",
    UTMZone=import_osm_features_108.UTMZone,
    TranslationVector=import_osm_features_108.TranslationVector,
    ImportAltitude=False)  # -> Points, Metadata, UTMZone, TranslationVector
polyline_43 = PolyLine(Vertices=import_osm_features_110.Points, Closed=False)
polyline_44 = PolyLine(Vertices=import_osm_features_108.Points, Closed=False)
create_street_network_22 = CreateStreetNetwork(
    StreetCurves=flatten(polyline_43),
    Metadata=flatten(import_osm_features_110.Metadata),
    SplitStreetCurves=False,
    UTMZone=import_osm_features_110.UTMZone,
    TranslationVector=import_osm_features_110.TranslationVector)  # -> StreetNetwork, StreetSegmentCurves, UTMZone, TranslationVector
create_amenity_22 = CreateAmenity(PointLocationOfAmenity=import_osm_features_109.Points, Metadata=import_osm_features_109.Metadata)
panel_93 = Panel(import_osm_features_107.Points)
panel_94 = Panel(import_osm_features_106.Points)
arrange_amenities_by_building_22 = ArrangeAmenitiesByBuilding(Amenities=flatten(create_amenity_22), Buildings=flatten(polyline_44))  # -> AmenitiesByBuilding, Buildings
list_length_43 = ListLength(List=flatten(panel_93))
list_length_44 = ListLength(List=flatten(panel_94))
create_building_22 = CreateBuilding(
    BuildingCurve=polyline_44,
    Metadata=import_osm_features_108.Metadata,
    AmenitiesInBuilding=arrange_amenities_by_building_22.AmenitiesByBuilding)

# ----
# OSM MODEL
import_osm_features_111 = ImportOSMFeatures(OSMPathOrURL=file_path_46, OSMFeatureType="tourism", Format="xml", ImportAltitude=False)  # -> Points, Metadata, UTMZone, TranslationVector
import_osm_features_112 = ImportOSMFeatures(OSMPathOrURL=file_path_46, OSMFeatureType="public_transport", Format="xml", ImportAltitude=False)  # -> Points, Metadata, UTMZone, TranslationVector
import_osm_features_113 = ImportOSMFeatures(OSMPathOrURL=file_path_46, OSMFeatureType="building", Format="xml", ImportAltitude=False)  # -> Points, Metadata, UTMZone, TranslationVector
import_osm_features_114 = ImportOSMFeatures(OSMPathOrURL=file_path_46, OSMFeatureType="amenity", Format="xml", ImportAltitude=False)  # -> Points, Metadata, UTMZone, TranslationVector
import_osm_features_115 = ImportOSMFeatures(
    OSMPathOrURL=file_path_46,
    OSMFeatureType="street",
    Format="xml",
    UTMZone=import_osm_features_113.UTMZone,
    TranslationVector=import_osm_features_113.TranslationVector,
    ImportAltitude=False)  # -> Points, Metadata, UTMZone, TranslationVector
polyline_45 = PolyLine(Vertices=import_osm_features_115.Points, Closed=False)
polyline_46 = PolyLine(Vertices=import_osm_features_113.Points, Closed=False)
create_street_network_23 = CreateStreetNetwork(
    StreetCurves=flatten(polyline_45),
    Metadata=flatten(import_osm_features_115.Metadata),
    SplitStreetCurves=False,
    UTMZone=import_osm_features_115.UTMZone,
    TranslationVector=import_osm_features_115.TranslationVector)  # -> StreetNetwork, StreetSegmentCurves, UTMZone, TranslationVector
create_amenity_23 = CreateAmenity(PointLocationOfAmenity=import_osm_features_114.Points, Metadata=import_osm_features_114.Metadata)
panel_95 = Panel(import_osm_features_112.Points)
panel_96 = Panel(import_osm_features_111.Points)
arrange_amenities_by_building_23 = ArrangeAmenitiesByBuilding(Amenities=flatten(create_amenity_23), Buildings=flatten(polyline_46))  # -> AmenitiesByBuilding, Buildings
list_length_45 = ListLength(List=flatten(panel_95))
list_length_46 = ListLength(List=flatten(panel_96))
create_building_23 = CreateBuilding(
    BuildingCurve=polyline_46,
    Metadata=import_osm_features_113.Metadata,
    AmenitiesInBuilding=arrange_amenities_by_building_23.AmenitiesByBuilding)

# ----
# OSM MODEL
import_osm_features_116 = ImportOSMFeatures(OSMPathOrURL=file_path_48, OSMFeatureType="tourism", Format="xml", ImportAltitude=False)  # -> Points, Metadata, UTMZone, TranslationVector
import_osm_features_117 = ImportOSMFeatures(OSMPathOrURL=file_path_48, OSMFeatureType="public_transport", Format="xml", ImportAltitude=False)  # -> Points, Metadata, UTMZone, TranslationVector
import_osm_features_118 = ImportOSMFeatures(OSMPathOrURL=file_path_48, OSMFeatureType="building", Format="xml", ImportAltitude=False)  # -> Points, Metadata, UTMZone, TranslationVector
import_osm_features_119 = ImportOSMFeatures(OSMPathOrURL=file_path_48, OSMFeatureType="amenity", Format="xml", ImportAltitude=False)  # -> Points, Metadata, UTMZone, TranslationVector
import_osm_features_120 = ImportOSMFeatures(
    OSMPathOrURL=file_path_48,
    OSMFeatureType="street",
    Format="xml",
    UTMZone=import_osm_features_118.UTMZone,
    TranslationVector=import_osm_features_118.TranslationVector,
    ImportAltitude=False)  # -> Points, Metadata, UTMZone, TranslationVector
polyline_47 = PolyLine(Vertices=import_osm_features_120.Points, Closed=False)
polyline_48 = PolyLine(Vertices=import_osm_features_118.Points, Closed=False)
create_street_network_24 = CreateStreetNetwork(
    StreetCurves=flatten(polyline_47),
    Metadata=flatten(import_osm_features_120.Metadata),
    SplitStreetCurves=False,
    UTMZone=import_osm_features_120.UTMZone,
    TranslationVector=import_osm_features_120.TranslationVector)  # -> StreetNetwork, StreetSegmentCurves, UTMZone, TranslationVector
create_amenity_24 = CreateAmenity(PointLocationOfAmenity=import_osm_features_119.Points, Metadata=import_osm_features_119.Metadata)
panel_97 = Panel(import_osm_features_117.Points)
panel_98 = Panel(import_osm_features_116.Points)
arrange_amenities_by_building_24 = ArrangeAmenitiesByBuilding(Amenities=flatten(create_amenity_24), Buildings=flatten(polyline_48))  # -> AmenitiesByBuilding, Buildings
list_length_47 = ListLength(List=flatten(panel_97))
list_length_48 = ListLength(List=flatten(panel_98))
create_building_24 = CreateBuilding(
    BuildingCurve=polyline_48,
    Metadata=import_osm_features_118.Metadata,
    AmenitiesInBuilding=arrange_amenities_by_building_24.AmenitiesByBuilding)

# ----
# OSM MODEL
import_osm_features_121 = ImportOSMFeatures(OSMPathOrURL=file_path_50, OSMFeatureType="tourism", Format="xml", ImportAltitude=False)  # -> Points, Metadata, UTMZone, TranslationVector
import_osm_features_122 = ImportOSMFeatures(OSMPathOrURL=file_path_50, OSMFeatureType="public_transport", Format="xml", ImportAltitude=False)  # -> Points, Metadata, UTMZone, TranslationVector
import_osm_features_123 = ImportOSMFeatures(OSMPathOrURL=file_path_50, OSMFeatureType="building", Format="xml", ImportAltitude=False)  # -> Points, Metadata, UTMZone, TranslationVector
import_osm_features_124 = ImportOSMFeatures(OSMPathOrURL=file_path_50, OSMFeatureType="amenity", Format="xml", ImportAltitude=False)  # -> Points, Metadata, UTMZone, TranslationVector
import_osm_features_125 = ImportOSMFeatures(
    OSMPathOrURL=file_path_50,
    OSMFeatureType="street",
    Format="xml",
    UTMZone=import_osm_features_123.UTMZone,
    TranslationVector=import_osm_features_123.TranslationVector,
    ImportAltitude=False)  # -> Points, Metadata, UTMZone, TranslationVector
polyline_49 = PolyLine(Vertices=import_osm_features_125.Points, Closed=False)
polyline_50 = PolyLine(Vertices=import_osm_features_123.Points, Closed=False)
create_street_network_25 = CreateStreetNetwork(
    StreetCurves=flatten(polyline_49),
    Metadata=flatten(import_osm_features_125.Metadata),
    SplitStreetCurves=False,
    UTMZone=import_osm_features_125.UTMZone,
    TranslationVector=import_osm_features_125.TranslationVector)  # -> StreetNetwork, StreetSegmentCurves, UTMZone, TranslationVector
create_amenity_25 = CreateAmenity(PointLocationOfAmenity=import_osm_features_124.Points, Metadata=import_osm_features_124.Metadata)
panel_99 = Panel(import_osm_features_122.Points)
panel_100 = Panel(import_osm_features_121.Points)
arrange_amenities_by_building_25 = ArrangeAmenitiesByBuilding(Amenities=flatten(create_amenity_25), Buildings=flatten(polyline_50))  # -> AmenitiesByBuilding, Buildings
list_length_49 = ListLength(List=flatten(panel_99))
list_length_50 = ListLength(List=flatten(panel_100))
create_building_25 = CreateBuilding(
    BuildingCurve=polyline_50,
    Metadata=import_osm_features_123.Metadata,
    AmenitiesInBuilding=arrange_amenities_by_building_25.AmenitiesByBuilding)

panel_101 = Panel(list_length_6)
panel_102 = Panel(list_length_14)
panel_103 = Panel(list_length_26)
panel_104 = Panel(list_length_28)
panel_105 = Panel(list_length_32)
panel_106 = Panel(list_length_30)
panel_107 = Panel(list_length_34)
panel_108 = Panel(list_length_40)
panel_109 = Panel(list_length_38)
panel_110 = Panel(list_length_42)
panel_111 = Panel(list_length_46)
panel_112 = Panel(list_length_48)
panel_113 = Panel(list_length_50)
build_urbano_model = BuildUrbanoModel(Buildings=flatten(create_building), StreetNetwork=create_street_network.StreetNetwork, BuildToggle=True)  # -> UrbanoModel, BuildingCurves, Activities
build_urbano_model_2 = BuildUrbanoModel(Buildings=flatten(create_building_2), StreetNetwork=create_street_network_2.StreetNetwork, BuildToggle=True)  # -> UrbanoModel, BuildingCurves, Activities
build_urbano_model_3 = BuildUrbanoModel(Buildings=flatten(create_building_3), StreetNetwork=create_street_network_3.StreetNetwork, BuildToggle=True)  # -> UrbanoModel, BuildingCurves, Activities
build_urbano_model_4 = BuildUrbanoModel(Buildings=flatten(create_building_4), StreetNetwork=create_street_network_4.StreetNetwork, BuildToggle=True)  # -> UrbanoModel, BuildingCurves, Activities
build_urbano_model_5 = BuildUrbanoModel(Buildings=flatten(create_building_5), StreetNetwork=create_street_network_5.StreetNetwork, BuildToggle=True)  # -> UrbanoModel, BuildingCurves, Activities
build_urbano_model_6 = BuildUrbanoModel(Buildings=flatten(create_building_6), StreetNetwork=create_street_network_6.StreetNetwork, BuildToggle=True)  # -> UrbanoModel, BuildingCurves, Activities
build_urbano_model_7 = BuildUrbanoModel(Buildings=flatten(create_building_7), StreetNetwork=create_street_network_7.StreetNetwork, BuildToggle=True)  # -> UrbanoModel, BuildingCurves, Activities
build_urbano_model_8 = BuildUrbanoModel(Buildings=flatten(create_building_8), StreetNetwork=create_street_network_8.StreetNetwork, BuildToggle=True)  # -> UrbanoModel, BuildingCurves, Activities
build_urbano_model_9 = BuildUrbanoModel(Buildings=flatten(create_building_9), StreetNetwork=create_street_network_9.StreetNetwork, BuildToggle=True)  # -> UrbanoModel, BuildingCurves, Activities
build_urbano_model_10 = BuildUrbanoModel(Buildings=flatten(create_building_10), StreetNetwork=create_street_network_10.StreetNetwork, BuildToggle=True)  # -> UrbanoModel, BuildingCurves, Activities
build_urbano_model_11 = BuildUrbanoModel(Buildings=flatten(create_building_11), StreetNetwork=create_street_network_11.StreetNetwork, BuildToggle=True)  # -> UrbanoModel, BuildingCurves, Activities
build_urbano_model_12 = BuildUrbanoModel(Buildings=flatten(create_building_12), StreetNetwork=create_street_network_12.StreetNetwork, BuildToggle=True)  # -> UrbanoModel, BuildingCurves, Activities
build_urbano_model_13 = BuildUrbanoModel(Buildings=flatten(create_building_13), StreetNetwork=create_street_network_13.StreetNetwork, BuildToggle=True)  # -> UrbanoModel, BuildingCurves, Activities
build_urbano_model_14 = BuildUrbanoModel(Buildings=flatten(create_building_14), StreetNetwork=create_street_network_14.StreetNetwork, BuildToggle=True)  # -> UrbanoModel, BuildingCurves, Activities
build_urbano_model_15 = BuildUrbanoModel(Buildings=flatten(create_building_15), StreetNetwork=create_street_network_15.StreetNetwork, BuildToggle=True)  # -> UrbanoModel, BuildingCurves, Activities
build_urbano_model_16 = BuildUrbanoModel(Buildings=flatten(create_building_16), StreetNetwork=create_street_network_16.StreetNetwork, BuildToggle=True)  # -> UrbanoModel, BuildingCurves, Activities
build_urbano_model_17 = BuildUrbanoModel(Buildings=flatten(create_building_17), StreetNetwork=create_street_network_17.StreetNetwork, BuildToggle=True)  # -> UrbanoModel, BuildingCurves, Activities
build_urbano_model_18 = BuildUrbanoModel(Buildings=flatten(create_building_18), StreetNetwork=create_street_network_18.StreetNetwork, BuildToggle=True)  # -> UrbanoModel, BuildingCurves, Activities
build_urbano_model_19 = BuildUrbanoModel(Buildings=flatten(create_building_19), StreetNetwork=create_street_network_19.StreetNetwork, BuildToggle=True)  # -> UrbanoModel, BuildingCurves, Activities
build_urbano_model_20 = BuildUrbanoModel(Buildings=flatten(create_building_20), StreetNetwork=create_street_network_20.StreetNetwork, BuildToggle=True)  # -> UrbanoModel, BuildingCurves, Activities
build_urbano_model_21 = BuildUrbanoModel(Buildings=flatten(create_building_21), StreetNetwork=create_street_network_21.StreetNetwork, BuildToggle=True)  # -> UrbanoModel, BuildingCurves, Activities
build_urbano_model_22 = BuildUrbanoModel(Buildings=flatten(create_building_22), StreetNetwork=create_street_network_22.StreetNetwork, BuildToggle=True)  # -> UrbanoModel, BuildingCurves, Activities
build_urbano_model_23 = BuildUrbanoModel(Buildings=flatten(create_building_23), StreetNetwork=create_street_network_23.StreetNetwork, BuildToggle=True)  # -> UrbanoModel, BuildingCurves, Activities
build_urbano_model_24 = BuildUrbanoModel(Buildings=flatten(create_building_24), StreetNetwork=create_street_network_24.StreetNetwork, BuildToggle=True)  # -> UrbanoModel, BuildingCurves, Activities
build_urbano_model_25 = BuildUrbanoModel(Buildings=flatten(create_building_25), StreetNetwork=create_street_network_25.StreetNetwork, BuildToggle=True)  # -> UrbanoModel, BuildingCurves, Activities
panel_114 = Panel(build_urbano_model.Activities)
panel_115 = Panel(build_urbano_model_2.Activities)
panel_116 = Panel(build_urbano_model_4.Activities)
panel_117 = Panel(build_urbano_model_3.Activities)
panel_118 = Panel(build_urbano_model_6.Activities)
panel_119 = Panel(build_urbano_model_7.Activities)
panel_120 = Panel(build_urbano_model_5.Activities)
panel_121 = Panel(build_urbano_model_10.Activities)
panel_122 = Panel(build_urbano_model_11.Activities)
panel_123 = Panel(build_urbano_model_8.Activities)
panel_124 = Panel(build_urbano_model_9.Activities)
panel_125 = Panel(build_urbano_model_13.Activities)
panel_126 = Panel(build_urbano_model_12.Activities)
panel_127 = Panel(build_urbano_model_14.Activities)
panel_128 = Panel(build_urbano_model_16.Activities)
panel_129 = Panel(build_urbano_model_15.Activities)
panel_130 = Panel(build_urbano_model_17.Activities)
panel_131 = Panel(build_urbano_model_20.Activities)
panel_132 = Panel(build_urbano_model_19.Activities)
panel_133 = Panel(build_urbano_model_21.Activities)
panel_134 = Panel(build_urbano_model_18.Activities)
panel_135 = Panel(build_urbano_model_22.Activities)
panel_136 = Panel(build_urbano_model_23.Activities)
panel_137 = Panel(build_urbano_model_24.Activities)
panel_138 = Panel(build_urbano_model_25.Activities)

# ----
# SELECT MANUALLY AN AMENITY BY TYPE
panel_139 = Panel("""post_office
bank
cinema
theatre
arts_centre
pharmacy
restaurant
fast_food
cafe
bar
pub
department_store
supermarket_store
convenience_store
hardware_store
clothes_store
books
shoes_store
beauty_store
store""")
find_amenities = FindAmenities(UrbanoModel=build_urbano_model.UrbanoModel, Activity=panel_139)
inspect_amenity = InspectAmenity(Amenity=find_amenities)  # -> Name, Activities, Host, Metadata
panel_140 = Panel(inspect_amenity.Metadata)

# ----
# SELECT MANUALLY AN AMENITY BY TYPE
panel_141 = Panel("""post_office
bank
cinema
theatre
arts_centre
pharmacy
restaurant
fast_food
cafe
bar
pub
department_store
supermarket_store
convenience_store
hardware_store
clothes_store
books
shoes_store
beauty_store
store""")
find_amenities_2 = FindAmenities(UrbanoModel=build_urbano_model_2.UrbanoModel, Activity=panel_141)
inspect_amenity_2 = InspectAmenity(Amenity=find_amenities_2)  # -> Name, Activities, Host, Metadata
panel_142 = Panel(inspect_amenity_2.Metadata)

# ----
# SELECT MANUALLY AN AMENITY BY TYPE
panel_143 = Panel("""post_office
bank
cinema
theatre
arts_centre
pharmacy
restaurant
fast_food
cafe
bar
pub
department_store
supermarket_store
convenience_store
hardware_store
clothes_store
books
shoes_store
beauty_store
store""")
find_amenities_3 = FindAmenities(UrbanoModel=build_urbano_model_4.UrbanoModel, Activity=panel_143)
inspect_amenity_3 = InspectAmenity(Amenity=find_amenities_3)  # -> Name, Activities, Host, Metadata
panel_144 = Panel(inspect_amenity_3.Metadata)

# ----
# SELECT MANUALLY AN AMENITY BY TYPE
panel_145 = Panel("""post_office
bank
cinema
theatre
arts_centre
pharmacy
restaurant
fast_food
cafe
bar
pub
department_store
supermarket_store
convenience_store
hardware_store
clothes_store
books
shoes_store
beauty_store
store""")
find_amenities_4 = FindAmenities(UrbanoModel=build_urbano_model_3.UrbanoModel, Activity=panel_145)
inspect_amenity_4 = InspectAmenity(Amenity=find_amenities_4)  # -> Name, Activities, Host, Metadata
panel_146 = Panel(inspect_amenity_4.Metadata)

# ----
# SELECT MANUALLY AN AMENITY BY TYPE
panel_147 = Panel("""post_office
bank
cinema
theatre
arts_centre
pharmacy
restaurant
fast_food
cafe
bar
pub
department_store
supermarket_store
convenience_store
hardware_store
clothes_store
books
shoes_store
beauty_store
store""")
find_amenities_5 = FindAmenities(UrbanoModel=build_urbano_model_6.UrbanoModel, Activity=panel_147)
inspect_amenity_5 = InspectAmenity(Amenity=find_amenities_5)  # -> Name, Activities, Host, Metadata
panel_148 = Panel(inspect_amenity_5.Metadata)

# ----
# SELECT MANUALLY AN AMENITY BY TYPE
panel_149 = Panel("""post_office
bank
cinema
theatre
arts_centre
pharmacy
restaurant
fast_food
cafe
bar
pub
department_store
supermarket_store
convenience_store
hardware_store
clothes_store
books
shoes_store
beauty_store
store""")
find_amenities_6 = FindAmenities(UrbanoModel=build_urbano_model_7.UrbanoModel, Activity=panel_149)
inspect_amenity_6 = InspectAmenity(Amenity=find_amenities_6)  # -> Name, Activities, Host, Metadata
panel_150 = Panel(inspect_amenity_6.Metadata)

# ----
# SELECT MANUALLY AN AMENITY BY TYPE
panel_151 = Panel("""post_office
bank
cinema
theatre
arts_centre
pharmacy
restaurant
fast_food
cafe
bar
pub
department_store
supermarket_store
convenience_store
hardware_store
clothes_store
books
shoes_store
beauty_store
store""")
find_amenities_7 = FindAmenities(UrbanoModel=build_urbano_model_5.UrbanoModel, Activity=panel_151)
inspect_amenity_7 = InspectAmenity(Amenity=find_amenities_7)  # -> Name, Activities, Host, Metadata
panel_152 = Panel(inspect_amenity_7.Metadata)

# ----
# SELECT MANUALLY AN AMENITY BY TYPE
panel_153 = Panel("""post_office
bank
cinema
theatre
arts_centre
pharmacy
restaurant
fast_food
cafe
bar
pub
department_store
supermarket_store
convenience_store
hardware_store
clothes_store
books
shoes_store
beauty_store
store""")
find_amenities_8 = FindAmenities(UrbanoModel=build_urbano_model_10.UrbanoModel, Activity=panel_153)
inspect_amenity_8 = InspectAmenity(Amenity=find_amenities_8)  # -> Name, Activities, Host, Metadata
panel_154 = Panel(inspect_amenity_8.Metadata)

# ----
# SELECT MANUALLY AN AMENITY BY TYPE
panel_155 = Panel("""post_office
bank
cinema
theatre
arts_centre
pharmacy
restaurant
fast_food
cafe
bar
pub
department_store
supermarket_store
convenience_store
hardware_store
clothes_store
books
shoes_store
beauty_store
store""")
find_amenities_9 = FindAmenities(UrbanoModel=build_urbano_model_11.UrbanoModel, Activity=panel_155)
inspect_amenity_9 = InspectAmenity(Amenity=find_amenities_9)  # -> Name, Activities, Host, Metadata
panel_156 = Panel(inspect_amenity_9.Metadata)

# ----
# SELECT MANUALLY AN AMENITY BY TYPE
panel_157 = Panel("""post_office
bank
cinema
theatre
arts_centre
pharmacy
restaurant
fast_food
cafe
bar
pub
department_store
supermarket_store
convenience_store
hardware_store
clothes_store
books
shoes_store
beauty_store
store""")
find_amenities_10 = FindAmenities(UrbanoModel=build_urbano_model_8.UrbanoModel, Activity=panel_157)
inspect_amenity_10 = InspectAmenity(Amenity=find_amenities_10)  # -> Name, Activities, Host, Metadata
panel_158 = Panel(inspect_amenity_10.Metadata)

# ----
# SELECT MANUALLY AN AMENITY BY TYPE
panel_159 = Panel("""post_office
bank
cinema
theatre
arts_centre
pharmacy
restaurant
fast_food
cafe
bar
pub
department_store
supermarket_store
convenience_store
hardware_store
clothes_store
books
shoes_store
beauty_store
store""")
find_amenities_11 = FindAmenities(UrbanoModel=build_urbano_model_9.UrbanoModel, Activity=panel_159)
inspect_amenity_11 = InspectAmenity(Amenity=find_amenities_11)  # -> Name, Activities, Host, Metadata
panel_160 = Panel(inspect_amenity_11.Metadata)

# ----
# SELECT MANUALLY AN AMENITY BY TYPE
panel_161 = Panel("""post_office
bank
cinema
theatre
arts_centre
pharmacy
restaurant
fast_food
cafe
bar
pub
department_store
supermarket_store
convenience_store
hardware_store
clothes_store
books
shoes_store
beauty_store
store""")
find_amenities_12 = FindAmenities(UrbanoModel=build_urbano_model_13.UrbanoModel, Activity=panel_161)
inspect_amenity_12 = InspectAmenity(Amenity=find_amenities_12)  # -> Name, Activities, Host, Metadata
panel_162 = Panel(inspect_amenity_12.Metadata)

# ----
# SELECT MANUALLY AN AMENITY BY TYPE
panel_163 = Panel("""post_office
bank
cinema
theatre
arts_centre
pharmacy
restaurant
fast_food
cafe
bar
pub
department_store
supermarket_store
convenience_store
hardware_store
clothes_store
books
shoes_store
beauty_store
store""")
find_amenities_13 = FindAmenities(UrbanoModel=build_urbano_model_12.UrbanoModel, Activity=panel_163)
inspect_amenity_13 = InspectAmenity(Amenity=find_amenities_13)  # -> Name, Activities, Host, Metadata
panel_164 = Panel(inspect_amenity_13.Metadata)

# ----
# SELECT MANUALLY AN AMENITY BY TYPE
panel_165 = Panel("""post_office
bank
cinema
theatre
arts_centre
pharmacy
restaurant
fast_food
cafe
bar
pub
department_store
supermarket_store
convenience_store
hardware_store
clothes_store
books
shoes_store
beauty_store
store""")
find_amenities_14 = FindAmenities(UrbanoModel=build_urbano_model_14.UrbanoModel, Activity=panel_165)
inspect_amenity_14 = InspectAmenity(Amenity=find_amenities_14)  # -> Name, Activities, Host, Metadata
panel_166 = Panel(inspect_amenity_14.Metadata)

# ----
# SELECT MANUALLY AN AMENITY BY TYPE
panel_167 = Panel("""post_office
bank
cinema
theatre
arts_centre
pharmacy
restaurant
fast_food
cafe
bar
pub
department_store
supermarket_store
convenience_store
hardware_store
clothes_store
books
shoes_store
beauty_store
store""")
find_amenities_15 = FindAmenities(UrbanoModel=build_urbano_model_16.UrbanoModel, Activity=panel_167)
inspect_amenity_15 = InspectAmenity(Amenity=find_amenities_15)  # -> Name, Activities, Host, Metadata
panel_168 = Panel(inspect_amenity_15.Metadata)

# ----
# SELECT MANUALLY AN AMENITY BY TYPE
panel_169 = Panel("""post_office
bank
cinema
theatre
arts_centre
pharmacy
restaurant
fast_food
cafe
bar
pub
department_store
supermarket_store
convenience_store
hardware_store
clothes_store
books
shoes_store
beauty_store
store""")
find_amenities_16 = FindAmenities(UrbanoModel=build_urbano_model_15.UrbanoModel, Activity=panel_169)
inspect_amenity_16 = InspectAmenity(Amenity=find_amenities_16)  # -> Name, Activities, Host, Metadata
panel_170 = Panel(inspect_amenity_16.Metadata)

# ----
# SELECT MANUALLY AN AMENITY BY TYPE
panel_171 = Panel("""post_office
bank
cinema
theatre
arts_centre
pharmacy
restaurant
fast_food
cafe
bar
pub
department_store
supermarket_store
convenience_store
hardware_store
clothes_store
books
shoes_store
beauty_store
store""")
find_amenities_17 = FindAmenities(UrbanoModel=build_urbano_model_17.UrbanoModel, Activity=panel_171)
inspect_amenity_17 = InspectAmenity(Amenity=find_amenities_17)  # -> Name, Activities, Host, Metadata
panel_172 = Panel(inspect_amenity_17.Metadata)

# ----
# SELECT MANUALLY AN AMENITY BY TYPE
panel_173 = Panel("""post_office
bank
cinema
theatre
arts_centre
pharmacy
restaurant
fast_food
cafe
bar
pub
department_store
supermarket_store
convenience_store
hardware_store
clothes_store
books
shoes_store
beauty_store
store""")
find_amenities_18 = FindAmenities(UrbanoModel=build_urbano_model_19.UrbanoModel, Activity=panel_173)
inspect_amenity_18 = InspectAmenity(Amenity=find_amenities_18)  # -> Name, Activities, Host, Metadata
panel_174 = Panel(inspect_amenity_18.Metadata)

# ----
# SELECT MANUALLY AN AMENITY BY TYPE
panel_175 = Panel("""post_office
bank
cinema
theatre
arts_centre
pharmacy
restaurant
fast_food
cafe
bar
pub
department_store
supermarket_store
convenience_store
hardware_store
clothes_store
books
shoes_store
beauty_store
store""")
find_amenities_19 = FindAmenities(UrbanoModel=build_urbano_model_20.UrbanoModel, Activity=panel_175)
inspect_amenity_19 = InspectAmenity(Amenity=find_amenities_19)  # -> Name, Activities, Host, Metadata
panel_176 = Panel(inspect_amenity_19.Metadata)

# ----
# SELECT MANUALLY AN AMENITY BY TYPE
panel_177 = Panel("""post_office
bank
cinema
theatre
arts_centre
pharmacy
restaurant
fast_food
cafe
bar
pub
department_store
supermarket_store
convenience_store
hardware_store
clothes_store
books
shoes_store
beauty_store
store""")
find_amenities_20 = FindAmenities(UrbanoModel=build_urbano_model_21.UrbanoModel, Activity=panel_177)
inspect_amenity_20 = InspectAmenity(Amenity=find_amenities_20)  # -> Name, Activities, Host, Metadata
panel_178 = Panel(inspect_amenity_20.Metadata)

# ----
# SELECT MANUALLY AN AMENITY BY TYPE
panel_179 = Panel("""post_office
bank
cinema
theatre
arts_centre
pharmacy
restaurant
fast_food
cafe
bar
pub
department_store
supermarket_store
convenience_store
hardware_store
clothes_store
books
shoes_store
beauty_store
store""")
find_amenities_21 = FindAmenities(UrbanoModel=build_urbano_model_18.UrbanoModel, Activity=panel_179)
inspect_amenity_21 = InspectAmenity(Amenity=find_amenities_21)  # -> Name, Activities, Host, Metadata
panel_180 = Panel(inspect_amenity_21.Metadata)

# ----
# SELECT MANUALLY AN AMENITY BY TYPE
panel_181 = Panel("""post_office
bank
cinema
theatre
arts_centre
pharmacy
restaurant
fast_food
cafe
bar
pub
department_store
supermarket_store
convenience_store
hardware_store
clothes_store
books
shoes_store
beauty_store
store""")
find_amenities_22 = FindAmenities(UrbanoModel=build_urbano_model_22.UrbanoModel, Activity=panel_181)
inspect_amenity_22 = InspectAmenity(Amenity=find_amenities_22)  # -> Name, Activities, Host, Metadata
panel_182 = Panel(inspect_amenity_22.Metadata)

# ----
# SELECT MANUALLY AN AMENITY BY TYPE
panel_183 = Panel("""post_office
bank
cinema
theatre
arts_centre
pharmacy
restaurant
fast_food
cafe
bar
pub
department_store
supermarket_store
convenience_store
hardware_store
clothes_store
books
shoes_store
beauty_store
store""")
find_amenities_23 = FindAmenities(UrbanoModel=build_urbano_model_23.UrbanoModel, Activity=panel_183)
inspect_amenity_23 = InspectAmenity(Amenity=find_amenities_23)  # -> Name, Activities, Host, Metadata
panel_184 = Panel(inspect_amenity_23.Metadata)

# ----
# SELECT MANUALLY AN AMENITY BY TYPE
panel_185 = Panel("""post_office
bank
cinema
theatre
arts_centre
pharmacy
restaurant
fast_food
cafe
bar
pub
department_store
supermarket_store
convenience_store
hardware_store
clothes_store
books
shoes_store
beauty_store
store""")
find_amenities_24 = FindAmenities(UrbanoModel=build_urbano_model_24.UrbanoModel, Activity=panel_185)
inspect_amenity_24 = InspectAmenity(Amenity=find_amenities_24)  # -> Name, Activities, Host, Metadata
panel_186 = Panel(inspect_amenity_24.Metadata)

# ----
# SELECT MANUALLY AN AMENITY BY TYPE
panel_187 = Panel("""post_office
bank
cinema
theatre
arts_centre
pharmacy
restaurant
fast_food
cafe
bar
pub
department_store
supermarket_store
convenience_store
hardware_store
clothes_store
books
shoes_store
beauty_store
store""")
find_amenities_25 = FindAmenities(UrbanoModel=build_urbano_model_25.UrbanoModel, Activity=panel_187)
inspect_amenity_25 = InspectAmenity(Amenity=find_amenities_25)  # -> Name, Activities, Host, Metadata
panel_188 = Panel(inspect_amenity_25.Metadata)

panel_189 = Panel(find_amenities)
lng = ListLength(List=panel_189)
panel_190 = Panel(list_length)
panel_191 = Panel(list_length_2)
data = Data(flatten(lng))
panel_192 = Panel(data)

# ----
# Aminity List from Urbano
panel_193 = Panel(find_amenities_2)
lng_2 = ListLength(List=panel_193)
panel_194 = Panel(list_length_3)
panel_195 = Panel(list_length_4)
data_2 = Data(flatten(lng_2))
panel_196 = Panel(data_2)

panel_197 = Panel(find_amenities_3)
lng_3 = ListLength(List=panel_197)
panel_198 = Panel(list_length_7)
panel_199 = Panel(list_length_8)
data_3 = Data(flatten(lng_3))
panel_200 = Panel(data_3)

panel_201 = Panel(find_amenities_4)
lng_4 = ListLength(List=panel_201)
panel_202 = Panel(list_length_5)
panel_203 = Panel(panel_101)
data_4 = Data(flatten(lng_4))
panel_204 = Panel(data_4)

panel_205 = Panel(find_amenities_5)
lng_5 = ListLength(List=panel_205)
panel_206 = Panel(list_length_11)
panel_207 = Panel(list_length_12)
data_5 = Data(flatten(lng_5))
panel_208 = Panel(data_5)

panel_209 = Panel(find_amenities_6)
lng_6 = ListLength(List=panel_209)
panel_210 = Panel(list_length_13)
panel_211 = Panel(panel_102)
data_6 = Data(flatten(lng_6))
panel_212 = Panel(data_6)

panel_213 = Panel(find_amenities_7)
lng_7 = ListLength(List=panel_213)
panel_214 = Panel(list_length_9)
panel_215 = Panel("0")
data_7 = Data(flatten(lng_7))
panel_216 = Panel(data_7)

panel_217 = Panel(find_amenities_8)
lng_8 = ListLength(List=panel_217)
panel_218 = Panel(list_length_19)
panel_219 = Panel(list_length_20)
data_8 = Data(flatten(lng_8))
panel_220 = Panel(data_8)

panel_221 = Panel(find_amenities_9)
lng_9 = ListLength(List=panel_221)
panel_222 = Panel(list_length_21)
panel_223 = Panel("0")
data_9 = Data(flatten(lng_9))
panel_224 = Panel(data_9)

panel_225 = Panel(find_amenities_10)
lng_10 = ListLength(List=panel_225)
panel_226 = Panel(list_length_15)
panel_227 = Panel("0")
data_10 = Data(flatten(lng_10))
panel_228 = Panel(data_10)

panel_229 = Panel(find_amenities_11)
lng_11 = ListLength(List=panel_229)
panel_230 = Panel(list_length_17)
panel_231 = Panel("0")
data_11 = Data(flatten(lng_11))
panel_232 = Panel(data_11)

panel_233 = Panel(find_amenities_12)
lng_12 = ListLength(List=panel_233)
panel_234 = Panel(list_length_25)
panel_235 = Panel(panel_103)
data_12 = Data(flatten(lng_12))
panel_236 = Panel(data_12)

panel_237 = Panel(find_amenities_13)
lng_13 = ListLength(List=panel_237)
panel_238 = Panel(list_length_23)
panel_239 = Panel("0")
data_13 = Data(flatten(lng_13))
panel_240 = Panel(data_13)

panel_241 = Panel(find_amenities_14)
lng_14 = ListLength(List=panel_241)
panel_242 = Panel(list_length_27)
panel_243 = Panel(panel_104)
data_14 = Data(flatten(lng_14))
panel_244 = Panel(data_14)

panel_245 = Panel(find_amenities_15)
lng_15 = ListLength(List=panel_245)
panel_246 = Panel(list_length_31)
panel_247 = Panel(panel_105)
data_15 = Data(flatten(lng_15))
panel_248 = Panel(data_15)

panel_249 = Panel(find_amenities_16)
lng_16 = ListLength(List=panel_249)
panel_250 = Panel(list_length_29)
panel_251 = Panel(panel_106)
data_16 = Data(flatten(lng_16))
panel_252 = Panel(data_16)

panel_253 = Panel(find_amenities_17)
lng_17 = ListLength(List=panel_253)
panel_254 = Panel(list_length_33)
panel_255 = Panel(panel_107)
data_17 = Data(flatten(lng_17))
panel_256 = Panel(data_17)

panel_257 = Panel(find_amenities_19)
lng_18 = ListLength(List=panel_257)
panel_258 = Panel(list_length_39)
panel_259 = Panel(panel_108)
data_18 = Data(flatten(lng_18))
panel_260 = Panel(data_18)

panel_261 = Panel(find_amenities_18)
lng_19 = ListLength(List=panel_261)
panel_262 = Panel(list_length_37)
panel_263 = Panel(panel_109)
data_19 = Data(flatten(lng_19))
panel_264 = Panel(data_19)

panel_265 = Panel(find_amenities_20)
lng_20 = ListLength(List=panel_265)
panel_266 = Panel(list_length_41)
panel_267 = Panel(panel_110)
data_20 = Data(flatten(lng_20))
panel_268 = Panel(data_20)

panel_269 = Panel(find_amenities_21)
lng_21 = ListLength(List=panel_269)
panel_270 = Panel(list_length_35)
panel_271 = Panel("0")
data_21 = Data(flatten(lng_21))
panel_272 = Panel(data_21)

panel_273 = Panel(find_amenities_22)
lng_22 = ListLength(List=panel_273)
panel_274 = Panel(list_length_43)
panel_275 = Panel("0")
data_22 = Data(flatten(lng_22))
panel_276 = Panel(data_22)

panel_277 = Panel(find_amenities_23)
lng_23 = ListLength(List=panel_277)
panel_278 = Panel(list_length_45)
panel_279 = Panel(panel_111)
data_23 = Data(flatten(lng_23))
panel_280 = Panel(data_23)

panel_281 = Panel(find_amenities_24)
lng_24 = ListLength(List=panel_281)
panel_282 = Panel(list_length_47)
panel_283 = Panel(panel_112)
data_24 = Data(flatten(lng_24))
panel_284 = Panel(data_24)

panel_285 = Panel(find_amenities_25)
lng_25 = ListLength(List=panel_285)
panel_286 = Panel(list_length_49)
panel_287 = Panel(panel_113)
data_25 = Data(flatten(lng_25))
panel_288 = Panel(data_25)

# ----
# Input Pedestrian Number here
panel_289 = Panel("4271")

# ----
# No. of Pedestrians
# Input Pedestrian Number here
panel_290 = Panel("23193")

# ----
# Input Pedestrian Number here
panel_291 = Panel("25734")

# ----
# Input Pedestrian Number here
panel_292 = Panel("9186")

# ----
# Input Pedestrian Number here
panel_293 = Panel("10494")

# ----
# Input Pedestrian Number here
panel_294 = Panel("16774")

# ----
# Input Pedestrian Number here
panel_295 = Panel("4375")

# ----
# Input Pedestrian Number here
panel_296 = Panel("8087")

# ----
# Input Pedestrian Number here
panel_297 = Panel("7668")

# ----
# Input Pedestrian Number here
panel_298 = Panel("4684")

# ----
# Input Pedestrian Number here
panel_299 = Panel("4765")

# ----
# Input Pedestrian Number here
panel_300 = Panel("12024")

# ----
# Input Pedestrian Number here
panel_301 = Panel("8450")

# ----
# Input Pedestrian Number here
panel_302 = Panel("22146")

# ----
# Input Pedestrian Number here
panel_303 = Panel("4501")

# ----
# Input Pedestrian Number here
panel_304 = Panel("12806")

# ----
# Input Pedestrian Number here
panel_305 = Panel("9340")

# ----
# Input Pedestrian Number here
panel_306 = Panel("11761")

# ----
# Input Pedestrian Number here
panel_307 = Panel("9926")

# ----
# Input Pedestrian Number here
panel_308 = Panel("10725")

# ----
# Input Pedestrian Number here
panel_309 = Panel("1788")

# ----
# Input Pedestrian Number here
panel_310 = Panel("17338")

# ----
# Input Pedestrian Number here
panel_311 = Panel("649")

# ----
# Input Pedestrian Number here
panel_312 = Panel("17784")

# ----
# Input Pedestrian Number here
panel_313 = Panel("13429")

# ----
# Input Density here
panel_314 = Panel("Pt52")

join = TextJoin(Text=[panel_314, panel_192, panel_190, panel_191, panel_289], Join=",")
panel_315 = Panel(join)

# ----
# Density of region
# Input Density here
panel_316 = Panel("Pt51")

join_2 = TextJoin(Text=[panel_316, panel_196, panel_194, panel_195, panel_290], Join=",")
panel_317 = Panel(join_2)

# ----
# Input Density here
panel_318 = Panel("Pt55")

join_3 = TextJoin(Text=[panel_318, panel_200, panel_198, panel_199, panel_292], Join=",")
panel_319 = Panel(join_3)

# ----
# Input Density here
panel_320 = Panel("Pt57")

join_4 = TextJoin(Text=[panel_320, panel_204, panel_202, panel_203, panel_291], Join=",")
panel_321 = Panel(join_4)

# ----
# Input Density here
panel_322 = Panel("Pt53")

join_5 = TextJoin(Text=[panel_322, panel_208, panel_206, panel_207, panel_293], Join=",")
panel_323 = Panel(join_5)

# ----
# Input Density here
panel_324 = Panel("Pt58")

join_6 = TextJoin(Text=[panel_324, panel_212, panel_210, panel_211, panel_294], Join=",")
panel_325 = Panel(join_6)

# ----
# Input Density here
panel_326 = Panel("Pt72")

join_7 = TextJoin(Text=[panel_326, panel_216, panel_214, panel_215, panel_295], Join=",")
panel_327 = Panel(join_7)

# ----
# Input Density here
panel_328 = Panel("Pt54")

join_8 = TextJoin(Text=[panel_328, panel_220, panel_218, panel_219, panel_296], Join=",")
panel_329 = Panel(join_8)

# ----
# Input Density here
panel_330 = Panel("Pt56")

join_9 = TextJoin(Text=[panel_330, panel_224, panel_222, panel_223, panel_297], Join=",")
panel_331 = Panel(join_9)

# ----
# Input Density here
panel_332 = Panel("Pt71")

join_10 = TextJoin(Text=[panel_332, panel_228, panel_226, panel_227, panel_298], Join=",")
panel_333 = Panel(join_10)

# ----
# Input Density here
panel_334 = Panel("Pt74")

join_11 = TextJoin(Text=[panel_334, panel_232, panel_230, panel_231, panel_299], Join=",")
panel_335 = Panel(join_11)

# ----
# Input Density here
panel_336 = Panel("Pt59")

join_12 = TextJoin(Text=[panel_336, panel_236, panel_234, panel_235, panel_300], Join=",")
panel_337 = Panel(join_12)

# ----
# Input Density here
panel_338 = Panel("Pt73")

join_13 = TextJoin(Text=[panel_338, panel_240, panel_238, panel_239, panel_301], Join=",")
panel_339 = Panel(join_13)

# ----
# Input Density here
panel_340 = Panel("Pt65")

join_14 = TextJoin(Text=[panel_340, panel_244, panel_242, panel_243, panel_302], Join=",")
panel_341 = Panel(join_14)

# ----
# Input Density here
panel_342 = Panel("Pt60")

join_15 = TextJoin(Text=[panel_342, panel_248, panel_246, panel_247, panel_303], Join=",")
panel_343 = Panel(join_15)

# ----
# Input Density here
panel_344 = Panel("Pt69")

join_16 = TextJoin(Text=[panel_344, panel_252, panel_250, panel_251, panel_304], Join=",")
panel_345 = Panel(join_16)

# ----
# Input Density here
panel_346 = Panel("Pt62")

join_17 = TextJoin(Text=[panel_346, panel_264, panel_262, panel_263, panel_307], Join=",")
panel_347 = Panel(join_17)

# ----
# Input Density here
panel_348 = Panel("Pt64")

join_18 = TextJoin(Text=[panel_348, panel_256, panel_254, panel_255, panel_305], Join=",")
panel_349 = Panel(join_18)

# ----
# Input Density here
panel_350 = Panel("Pt61")

join_19 = TextJoin(Text=[panel_350, panel_260, panel_258, panel_259, panel_306], Join=",")
panel_351 = Panel(join_19)

# ----
# Input Density here
panel_352 = Panel("Pt63")

join_20 = TextJoin(Text=[panel_352, panel_268, panel_266, panel_267, panel_308], Join=",")
panel_353 = Panel(join_20)

# ----
# Input Density here
panel_354 = Panel("Pt75")

join_21 = TextJoin(Text=[panel_354, panel_272, panel_270, panel_271, panel_309], Join=",")
panel_355 = Panel(join_21)

# ----
# Input Density here
panel_356 = Panel("Pt70")

join_22 = TextJoin(Text=[panel_356, panel_276, panel_274, panel_275, panel_311], Join=",")
panel_357 = Panel(join_22)

# ----
# Input Density here
panel_358 = Panel("Pt68")

join_23 = TextJoin(Text=[panel_358, panel_280, panel_278, panel_279, panel_310], Join=",")
panel_359 = Panel(join_23)

# ----
# Input Density here
panel_360 = Panel("Pt66")

join_24 = TextJoin(Text=[panel_360, panel_284, panel_282, panel_283, panel_312], Join=",")
panel_361 = Panel(join_24)

# ----
# Input Density here
panel_362 = Panel("Pt67")

join_25 = TextJoin(Text=[panel_362, panel_288, panel_286, panel_287, panel_313], Join=",")
panel_363 = Panel(join_25)

panel_364 = Panel("""density
post_office
bank
cinema
theatre
arts_centre
pharmacy
restaurant
fast_food
cafe
bar
pub
department_store
supermarket_store
convenience_store
hardware_store
clothes_store
books
shoes_store
beauty_store
store
public_transport
tourism
pedestrian total""")

# ----
# input a path to save the csv
aminity_list = Data(flatten(panel_364))
join_26 = TextJoin(Text=aminity_list, Join=",")
panel_365 = Panel(join_26)
entwine = Entwine(
    Branch00=panel_365,
    Branch01=panel_317,
    Branch02=panel_315,
    Branch03=panel_323,
    Branch04=panel_329,
    Branch05=panel_319,
    Branch06=panel_331,
    Branch07=panel_321,
    Branch08=panel_325,
    Branch09=panel_337,
    Branch010=panel_343,
    Branch011=panel_351,
    Branch012=panel_347,
    Branch013=panel_353,
    Branch014=panel_349,
    Branch015=panel_341,
    Branch016=panel_361,
    Branch017=panel_363,
    Branch018=panel_359,
    Branch019=panel_345,
    Branch020=panel_357,
    Branch021=panel_333,
    Branch022=panel_327,
    Branch023=panel_339,
    Branch024=panel_335,
    Branch025=panel_355,
    FlattenInputs=True)  # -> flatten(Result)
panel_366 = Panel(entwine)

# ---- group: c# script to save as csv
# Merging List to CSV
button = Button()
path = FilePath("D:\MaCad\A.I and M.L\studio\Data Set for Prediction\51to75.csv")
c_script = CSharpScript(save=button, path=path, data=panel_366)  # -> out, A; inputs save: Boolean, path: String, data: list of String
# ---------- c_script: C# ----------
    if (save){
      var fileinfo = new System.IO.FileInfo(path);
      if(!fileinfo.Directory.Exists){
        fileinfo.Directory.Create();
      }

      var sw = fileinfo.CreateText();
      for(int i = 0; i < data.Count; i++){
        string row = data[i];
        if(i < data.Count - 1){
          sw.WriteLine(row);
        }
        else {
          sw.Write(row);
        }
      }
      sw.Flush();
      sw.Close();
    }
# ---------- c_script: C# additional code ----------
  //Return a BoundingBox that contains all the geometry you are about to draw.
  public override BoundingBox ClippingBox
  {
    get
    {
      return BoundingBox.Empty;
    }
  }

  //Draw all meshes in this method.
  public override void DrawViewportMeshes(IGH_PreviewArgs args)
  {
  }

  //Draw all wires and points in this method.
  public override void DrawViewportWires(IGH_PreviewArgs args)
  {
  }
# ---------- end c_script ----------
