# Grasshopper definition 2 - Manhattan FBX Tiles.gh (Grasshopper 1.0.7)
# plug-ins: Bifocals, Moonlight, Urbano, jSwan, LunchBox

# INSTRUCTIONS
# STEP I - INPUT OSM MAP/ OSM CORDINATES
# STEP II - SELECT TILE TO GENERATE
# STEP III - CLICK BUTTON TO BAKE
moonlight = Moonlight(Mode=invert(False))

# ----
# Manhattan
file_path = FilePath("D:\MaCad\A.I and M.L\studio\URBANO-NYC\Manhattan")
# DOWNLOAD MAP FROM CORDINATES / INPUT DOWNLOADED OSM MAP DIRECTLY
panel = Panel("-73.9936")
download_openstreetmap_osm = DownloadOpenStreetMapOSM(LeftBound=panel, RightBound="-73.9684", TopBound="40.7677", BottomBound="40.7567", FilePath=file_path, RunToggle=True)  # -> OSMQueryURL, OSMFilePath
file_path_2 = FilePath(download_openstreetmap_osm.OSMFilePath)
panel_2 = Panel(download_openstreetmap_osm.OSMQueryURL)

# ----
# OSM MAP HERE:
path = FilePath("D:\Download\map (3)")
# STEP I
panel_3 = Panel("50m")
panel_4 = Panel("Building_center")  # disabled
# BAKE LAYERS
button = Button()
pt = ConstructPoint(XCoordinate=0, YCoordinate=0, ZCoordinate=0)
Z = UnitZ(Factor=Slider(10, range=0..10))
Z_2 = UnitZ(Factor=1)

md_slider = MDSlider(
    SliderMode=0,
    slider_value=Point(1, 0.1841531149, 0.5),
    x_domain=Domain(0, 1),
    y_domain=Domain(0, 1),
    z_domain=Domain(0, 1))
number_slider = Slider(1000, range=0..1000)
multiplication = Multiplication(A=Slider(2000, range=0..10000), B=md_slider)
pdecon = Deconstruct(Point=multiplication)  # -> XComponent, YComponent, ZComponent
pt_2 = ConstructPoint(XCoordinate=pdecon.XComponent, YCoordinate=pdecon.YComponent, ZCoordinate=pdecon.ZComponent)
number_slider_2 = Slider(400, range=0..1000)
multiplication_2 = Multiplication(A=Slider(5, range=0..10), B=number_slider_2)
multiplication_3 = Multiplication(A=Slider(3, range=0..10), B=number_slider_2)
rectangle = Rectangle(Plane=PlaneXY(0, 0, 0), XSize=multiplication_2, YSize=multiplication_3, Radius=0)  # -> Rectangle, Length
area = Area(Geometry=rectangle.Rectangle)  # -> Area, Centroid
item = ListItem(List=area.Centroid, Index=Slider(7, range=0..10), Wrap=True)

# ----
# Iterate through Grid Cell
number_slider_3 = Slider(3, range=0..10)
number_slider_4 = Slider(400, range=0..1000)
recgrid = Rectangular(Plane=pt_2, SizeX=number_slider_4, SizeY=number_slider_4, ExtentX=number_slider_3, ExtentY=Slider(5, range=0..10))  # -> flatten(Cells), Points

rotate = Rotate(Geometry=recgrid.Cells, Angle=degrees(Slider(61, range=0..100)), Plane=pt_2)  # -> Geometry, Transform

item_2 = ListItem(List=rotate.Geometry, Index=Slider(7, range=0..14), Wrap=True)

# ----
# OSM MODEL
import_osm_features = ImportOSMFeatures(
    OSMPathOrURL=path,
    OSMFeatureType="building",
    Format="xml",
    UTMZone=item_2,
    TranslationVector=item_2,
    CroppingGeometry=item_2,
    ImportAltitude=False)  # -> Points, Metadata, UTMZone, TranslationVector
import_osm_features_2 = ImportOSMFeatures(
    OSMPathOrURL=path,
    OSMFeatureType="amenity",
    Format="xml",
    UTMZone=item_2,
    TranslationVector=item_2,
    CroppingGeometry=item_2,
    ImportAltitude=False)  # -> Points, Metadata, UTMZone, TranslationVector
import_osm_features_3 = ImportOSMFeatures(OSMPathOrURL=path, OSMFeatureType="street", Format="xml", UTMZone=item_2, TranslationVector=item_2, ImportAltitude=False)  # -> Points, Metadata, UTMZone, TranslationVector
polyline = PolyLine(Vertices=import_osm_features_3.Points, Closed=False)
polyline_2 = PolyLine(Vertices=import_osm_features.Points, Closed=False)
create_amenity = CreateAmenity(PointLocationOfAmenity=import_osm_features_2.Points, Metadata=import_osm_features_2.Metadata)
create_street_network = CreateStreetNetwork(
    StreetCurves=flatten(polyline),
    Metadata=flatten(import_osm_features_3.Metadata),
    SplitStreetCurves=False,
    UTMZone=import_osm_features_3.UTMZone,
    TranslationVector=import_osm_features_3.TranslationVector)  # -> StreetNetwork, StreetSegmentCurves, UTMZone, TranslationVector
arrange_amenities_by_building = ArrangeAmenitiesByBuilding(Amenities=flatten(create_amenity), Buildings=flatten(polyline_2))  # -> AmenitiesByBuilding, Buildings
create_building = CreateBuilding(
    BuildingCurve=polyline_2,
    Metadata=import_osm_features.Metadata,
    AmenitiesInBuilding=arrange_amenities_by_building.AmenitiesByBuilding)

# ----
# RECOLOUR STREETS
number_slider_5 = Slider(47, range=10..50)  # disabled
range = Range(Domain=Domain(0, 1), Steps=number_slider_5)  # disabled
crv = Curve(polyline)  # disabled
shatter = Shatter(Curve=reparameterize(crv), Parameters=range)  # disabled
curvepoint = PointOnCurve(shatter, parameter=0.5)  # disabled
cps = ClosestPoints(Point=curvepoint, Cloud=flatten(curvepoint), Count=2)  # -> ClosestPoint, CPIndex, Distance; disabled
number_slider_6 = Slider(2, range=1..20)  # disabled
item_3 = ListItem(List=cps.ClosestPoint, Index=0, Wrap=True)  # -> Item1, Item; disabled
dist = Distance(PointA=graft(curvepoint), PointB=item_3.Item1)  # disabled
range_2 = Range(Domain=Domain(0, 1), Steps=number_slider_6)  # disabled
sort = SortList(Keys=flatten(dist), ValuesA=flatten(shatter))  # -> Keys, ValuesA; disabled
gradient = Gradient(
    LowerLimit=0,
    UpperLimit=1,
    Parameter=range_2,
    stops=[0: RGB(234, 38, 0), 0.5: RGB(254, 244, 84), 0.75: RGB(173, 203, 249), 1: RGB(75, 107, 169)])  # disabled
lng = ListLength(List=sort.Keys)  # disabled
division = Division(A=lng, B=number_slider_6)  # disabled
round = Round(Number=division)  # -> Nearest, Floor, Ceiling; disabled
partition = PartitionList(List=sort.ValuesA, Size=round.Ceiling)  # disabled
preview = CustomPreview(Geometry=partition, Shader=graft(gradient))  # disabled

# ----
# STEP II
# OSM MODEL
import_osm_features_4 = ImportOSMFeatures(
    OSMPathOrURL=path,
    OSMFeatureType="building",
    Format="xml",
    UTMZone=item_2,
    TranslationVector=item_2,
    CroppingGeometry=item_2,
    ImportAltitude=False)  # -> Points, Metadata, UTMZone, TranslationVector
import_osm_features_5 = ImportOSMFeatures(OSMPathOrURL=path, OSMFeatureType="amenity", Format="xml", ImportAltitude=False)  # -> Points, Metadata, UTMZone, TranslationVector
import_osm_features_6 = ImportOSMFeatures(OSMPathOrURL=path, OSMFeatureType="street", Format="xml", ImportAltitude=False)  # -> Points, Metadata, UTMZone, TranslationVector
polyline_3 = PolyLine(Vertices=import_osm_features_6.Points, Closed=False)
polyline_4 = PolyLine(Vertices=import_osm_features_4.Points, Closed=False)
create_amenity_2 = CreateAmenity(PointLocationOfAmenity=import_osm_features_5.Points, Metadata=import_osm_features_5.Metadata)
create_street_network_2 = CreateStreetNetwork(
    StreetCurves=flatten(polyline_3),
    Metadata=flatten(import_osm_features_6.Metadata),
    SplitStreetCurves=False,
    UTMZone=import_osm_features_6.UTMZone,
    TranslationVector=import_osm_features_6.TranslationVector)  # -> StreetNetwork, StreetSegmentCurves, UTMZone, TranslationVector
arrange_amenities_by_building_2 = ArrangeAmenitiesByBuilding(Amenities=flatten(create_amenity_2), Buildings=flatten(polyline_4))  # -> AmenitiesByBuilding, Buildings
create_building_2 = CreateBuilding(
    BuildingCurve=polyline_4,
    Metadata=import_osm_features_4.Metadata,
    AmenitiesInBuilding=arrange_amenities_by_building_2.AmenitiesByBuilding)

build_urbano_model = BuildUrbanoModel(Buildings=flatten(create_building), StreetNetwork=create_street_network.StreetNetwork, BuildToggle=True)  # -> UrbanoModel, BuildingCurves, Activities
build_urbano_model_2 = BuildUrbanoModel(Buildings=flatten(create_building_2), StreetNetwork=create_street_network_2.StreetNetwork, BuildToggle=True)  # -> UrbanoModel, BuildingCurves, Activities
# LIST OF AMINITIES IN THE WHOLE MAP
panel_5 = Panel(build_urbano_model_2.Activities)
# LIST OF AMINITIES IN THE TILE
panel_6 = Panel(build_urbano_model.Activities)

# ----
# STREET HIT ANALYSIS:
# 
# RED + ORANGE = HIGHER FOOT TRAFFIC
# 
# BLUE = LESS NUMBER OF PEDESTRIANS
# 
# NUMBER ON EACH STREET SEGMENT REPRESENTS ITS MAGNITUDE
# AMENITY HIT ANALYSIS:
# 
# RED + ORANGE = HIGHER FOOT TRAFFIC
# 
# BLUE = LESS NUMBER OF PEDESTRIANS
# 
# NUMBER ON EACH STREET SEGMENT REPRESENTS ITS MAGNITUDE
# 
# USE BUILDING HIT TO SEE TOTAL AMENITY HITS PER BUILDING
# CHANGE "LOAD ADP DATA" TO "24H"
# USE SLIDER TO "COLUMN INDEX"
# CHOOSE THE HOUR OF ACTIVITY DATA
# 
# WARNING: HEAVY COMPUTING, SLOW
hour = Slider(0, range=0..24)
activity_demand_profile_persona = ActivityDemandProfilePersona(
    ColumnIndex=1,
    Normalize=False,
    Persona="""post_office,0.001237014
bank,0.017194476
cinema,0.038842195
theatre,0.020781812
arts_centre,0.012370127
pharmacy,0.114794771
restaurant,0.196437603
fast_food,0.02350324
cafe,0.082756143
bar,0.101682436
pub,0.101682436
department_store,0.018926293
supermarket_store,0.071004524
convenience_store,0.018184085
hardware_store,0.015338957
clothes_store,0.092528544
books_store,0.010267204
shoes_store,0.025729863
beauty_store,0.036739274""")
adp_trip_engine = ADPTripEngine(
    UrbanoModel=build_urbano_model.UrbanoModel,
    Building=build_urbano_model.BuildingCurves,
    ActivityDemandProfile=activity_demand_profile_persona,
    SingleTravelMode="pedestrian",
    DestinationChoiceModel="nearest",
    BuildToggle=True)
street_hits = StreetHits(UrbanoModel=build_urbano_model.UrbanoModel, Trips=flatten(adp_trip_engine))  # -> StreetCurves, StreetHits, Trips
amenity_hits = AmenityHits(Trips=flatten(adp_trip_engine))  # -> Amenity, AmenityHits, AmenityHosts, Trips
building_hits = BuildingHits(Trips=flatten(adp_trip_engine))  # -> BuildingCurves, BuildingHits, BuildingTrips
trip_amenityscore = TripAmenityscore(Trips=flatten(adp_trip_engine))  # -> Amenityscore, Amenity, AmenityHosts
amenity = Panel(trip_amenityscore.Amenity)

# ----
# SELECT MANUALLY AN AMENITY BY TYPE
panel_7 = Panel("""post_office
bank
cinema
theatre
arts_centre
pharmacy
restaurant
fast_food
cafe
bar
pub
department_store
supermarket_store
convenience_store
hardware_store
clothes_store
books_store
shoes_store
beauty_store
store""")
list_item = ListItem(List=panel_7, Index=Slider(12, range=1..18), Wrap=True)
find_amenities = FindAmenities(UrbanoModel=build_urbano_model.UrbanoModel, Activity=list_item)
inspect_amenity = InspectAmenity(Amenity=find_amenities)  # -> Name, Activities, Host, Metadata
panel_8 = Panel(inspect_amenity.Activities)

# ----
# TRAVEL SIMULATION
# STREET & AMENITY HITS ANALYSIS
point = Point(Point(307.0340783, 244.0839638, 0))
router = Router(
    RouterUrbanoModelOrStreetNetwork=build_urbano_model.UrbanoModel,
    Origin=point,
    Destination=build_urbano_model.BuildingCurves,
    TravelMode="pedestrian",
    TimeLimit=-1)  # -> Trip, Route, Time, Distance
smaller_than = SmallerThan(FirstNumber=router.Time, SecondNumber=Slider(6, range=0..15))  # -> SmallerThan, OrEqualTo
dispatch = Dispatch(List=router.Trip, DispatchPattern=smaller_than.SmallerThan)  # -> ListA, ListB
inspect_trip = InspectTrip(Trip=dispatch.ListA)  # -> Origin, Destination, Time, Distance, Route, Mode, People, Activity, Amenity

data = Data(flatten(polyline_2))
data_2 = Data(build_urbano_model.BuildingCurves)
# BUILDING 3D
lookup = LookupMetadata(MetadataGeometry=import_osm_features.Metadata, SearchKey="height")
boundary = BoundarySurfaces(Edges=data)
data_3 = Data(flatten(lookup))
Z_3 = UnitZ(Factor=data_3)

# ----
# Roads
# STREET NETWORK - CROPPED
cropped_street_network = CroppedStreetNetwork(crv=item_2, data=import_osm_features_3.Points)
road_with_cross_walk = RoadWithCrossWalk(data=cropped_street_network)  # -> C, E, data_6
gate_points = GatePoints(B=road_with_cross_walk.E, relay=item_2, data=cropped_street_network, C=road_with_cross_walk.C)

extr = Extrude(Base=data, Direction=Z_3)
cap = CapHoles(Brep=extr)
preview_2 = CustomPreview(Geometry=cap, Material=ColourSwatch(SwatchColor=RGB(138, 138, 138)))
data_4 = Data(inspect_amenity.Host)
path_mapper = PathMapper(panel_8, source="{A;B;C}", target="{A;B}")
panel_9 = Panel(data_4)
panel_10 = Panel(path_mapper)
data_5 = Data(flatten(data_4))
data_6 = Data(flatten(panel_10))
rejson = SerializeJson(Aminity=data_6, Building=data_5, IncludeNullAndEmptyProperties=False)  # -> graft(JSON)
panel_11 = Panel(rejson)
join = TextJoin(Text=flatten(panel_11), Join=",")
panel_12 = Panel(join)
data_7 = Data(import_osm_features_2.Points)
area_2 = Area(Geometry=item_2)  # -> Area, Centroid
area_3 = Area(Geometry=item_2)  # -> Area, Centroid
area_4 = Area(Geometry=item_2)  # -> Area, Centroid
area_5 = Area(Geometry=item_2)  # -> Area, Centroid
area_6 = Area(Geometry=item_2)  # -> Area, Centroid
rotate_2 = Rotate(Geometry=gate_points, Angle=degrees(Slider(28.5, range=0..100)), Plane=area_2.Centroid)  # -> Geometry, Transform
rotate_3 = Rotate(Geometry=road_with_cross_walk.data_6, Angle=degrees(Slider(28.5, range=0..100)), Plane=area_3.Centroid)  # -> Geometry, Transform
rotate_4 = Rotate(Geometry=cap, Angle=degrees(Slider(28.5, range=0..100)), Plane=area_4.Centroid)  # -> Geometry, Transform
rotate_5 = Rotate(Geometry=data_7, Angle=degrees(Slider(28.5, range=0..100)), Plane=area_5.Centroid)  # -> Geometry, Transform
rotate_6 = Rotate(Geometry=item_2, Angle=degrees(Slider(28.5, range=0..100)), Plane=area_6.Centroid)  # -> Geometry, Transform
boundary_2 = BoundarySurfaces(Edges=rotate_6.Geometry)
debrep = DeconstructBrep(Brep=boundary_2)  # -> Faces, Edges, Vertices
item_4 = ListItem(List=debrep.Vertices, Index=0, Wrap=True)  # -> Item, Item1, Item2, Item3
data_8 = Data(item_4.Item3)
vec2pt = Vector2Pt(PointA=data_8, PointB=pt, Unitize=False)  # -> Vector, Length
# ENTRY AND EXIT GATES
move = Move(Geometry=rotate_2.Geometry, Motion=vec2pt.Vector)  # -> Geometry, Transform
# ROAD
move_2 = Move(Geometry=rotate_3.Geometry, Motion=vec2pt.Vector)  # -> Geometry, Transform
# BUILDINGS
move_3 = Move(Geometry=rotate_4.Geometry, Motion=vec2pt.Vector)  # -> Geometry, Transform
# BOUNDARY
move_4 = Move(Geometry=rotate_6.Geometry, Motion=vec2pt.Vector)  # -> Geometry, Transform
# PLANE
move_5 = Move(Geometry=boundary_2, Motion=vec2pt.Vector)  # -> Geometry, Transform
move_6 = Move(Geometry=rotate_5.Geometry, Motion=vec2pt.Vector)  # -> Geometry, Transform
randomsplit = RandomSplitList(MasterList=move.Geometry, Seed=2, Split=Slider(0.2, range=0..1))  # -> ListA, ListB
gates = Data(randomsplit.ListA)
cir = Circle(Plane=gates, Radius=1)
boundary_3 = BoundarySurfaces(Edges=cir)
randomsplit_2 = RandomSplitList(MasterList=boundary_3, Seed=2, Split=0.5)  # -> ListA, ListB
extr_2 = Extrude(Base=move_4.Geometry, Direction=Z)
destination = Data(randomsplit.ListB)
randomsplit_3 = RandomSplitList(MasterList=randomsplit_2.ListA, Seed=2, Split=0.5)  # -> ListA, ListB
randomsplit_4 = RandomSplitList(MasterList=randomsplit_2.ListB, Seed=2, Split=0.5)  # -> ListA, ListB
cir_2 = Circle(Plane=destination, Radius=1)
data_9 = Data(randomsplit_3.ListA)
data_10 = Data(randomsplit_3.ListB)
data_11 = Data(randomsplit_4.ListA)
data_12 = Data(randomsplit_4.ListB)
extr_3 = Extrude(Base=move_2.Geometry, Direction=Z_2)
bake = GhPythonScript(geo=extr_2, layer="Boundary", mSrc=0, active=button)  # -> out; inputs mSrc: Int32
# ---------- bake: Python ----------
__author__ = "Joseph Oster, IslandCAD.com"
__version__ = "2020.01.30"

import rhinoscriptsyntax as rs
import scriptcontext
import Rhino
import System

def bakeGeo(geometry, attributes, layer, rM, mSrc):
    if geometry:
        if layer is None: layer = 'Default'
        if not rs.IsLayer(layer): rs.AddLayer(layer)

        if rM is not None:
            matIndex = scriptcontext.doc.Materials.Add(rM)
            attributes.MaterialIndex = matIndex

        if (mSrc < 0) or (mSrc > 3): mSrc = 0 #must be 0=layer, 1=object or 2=parent
        if (mSrc == 0): #from layer
            if rM is not None:
                layerIndex = rs.LayerNames().index(layer)
                scriptcontext.doc.Layers[layerIndex].RenderMaterial = Rhino.Render.RenderMaterial.CreateBasicMaterial(rM)
            attributes.MaterialSource = Rhino.DocObjects.ObjectMaterialSource.MaterialFromLayer
        elif (mSrc == 1): #from object
            attributes.MaterialSource = Rhino.DocObjects.ObjectMaterialSource.MaterialFromObject
        else: #from parent
            attributes.MaterialSource = Rhino.DocObjects.ObjectMaterialSource.MaterialFromParent

        # add both the geometry and the attributes to the Rhino doc
        rhino_id = scriptcontext.doc.Objects.Add(geometry, attributes)
        rs.ObjectLayer(rhino_id, layer)
        #print rhino_id
        return rhino_id

if active: #change the scriptcontext
    scriptcontext.doc = Rhino.RhinoDoc.ActiveDoc
    try:
        if type(geo) is System.Guid:
            g = ghdoc.Objects.Find(geo)
            if g and hasattr(g, 'Geometry'):
                bakeGeo(g.Geometry, g.Attributes, layer, rM, mSrc)
        elif hasattr(geo, 'Count'): #assume group
            ids = []
            for g in geo:
                ids.append(bakeGeo(g, scriptcontext.doc.CreateDefaultAttributes(), layer, rM, mSrc))
            groupName = rs.AddGroup()
            rs.AddObjectsToGroup(ids, groupName)
        else: raise ValueError('Missing or Invalid geometry.')
    finally: #restore original Grasshopper document as default
        scriptcontext.doc = ghdoc
# ---------- end bake ----------
bake_2 = GhPythonScript(geo=move_5.Geometry, layer="Plane", mSrc=0, active=button)  # -> out; inputs mSrc: Int32; same code as bake
randomsplit_5 = RandomSplitList(MasterList=data_12, Seed=2, Split=0.5)  # -> ListA, ListB
boundary_4 = BoundarySurfaces(Edges=cir_2)
bake_3 = GhPythonScript(geo=data_9, layer="store_gate", mSrc=0, active=button)  # -> out; inputs mSrc: Int32; same code as bake
bake_4 = GhPythonScript(geo=data_10, layer="cafe_gate", mSrc=0, active=button)  # -> out; inputs mSrc: Int32; same code as bake
bake_5 = GhPythonScript(geo=data_11, layer="bank_gate", mSrc=0, active=button)  # -> out; inputs mSrc: Int32; same code as bake
bake_6 = GhPythonScript(geo=randomsplit_5.ListA, layer="pharm_gate", mSrc=0, active=button)  # -> out; inputs mSrc: Int32; same code as bake
bake_7 = GhPythonScript(geo=randomsplit_5.ListB, layer="Gates", mSrc=0, active=button)  # -> out; inputs mSrc: Int32; same code as bake
bake_8 = GhPythonScript(geo=boundary_4, layer="Destination", mSrc=0, active=button)  # -> out; inputs mSrc: Int32; same code as bake
bake_9 = GhPythonScript(geo=extr_3, layer="Road", mSrc=0, active=button)  # -> out; inputs mSrc: Int32; same code as bake

data_13 = Data(build_urbano_model.BuildingCurves)  # disabled
debrep_2 = DeconstructBrep(Brep=data_13)  # -> Faces, Edges, Vertices; disabled
panel_13 = Panel("Vertices")  # disabled
area_7 = Area(Geometry=data_13)  # -> Area, graft(Centroid); disabled
rejsonkv = SerializeKeysAndValues(Key=panel_13, Value=debrep_2.Vertices)  # disabled
panel_14 = Panel(area_7.Centroid)  # disabled
rejson_2 = SerializeJson(Building_Center=area_7.Centroid, D2=rejsonkv, IncludeNullAndEmptyProperties=False)  # disabled

# ----
# Convert to JSON
rejsonkv_2 = SerializeKeysAndValues(Key=panel_4, Value=area_7.Centroid)  # disabled
jmerge = MergeJson(SourceJson=rejsonkv_2, OverrideJson=rejsonkv)  # disabled

# ----
# STEP III
panel_15 = Panel(jmerge)  # disabled

# ----
# TRAIN STATION
# BUS STOPS
# BUS PLATFORMS
import_osm_features_7 = ImportOSMFeatures(
    OSMPathOrURL=path,
    OSMFeatureType="railway",
    Format="xml",
    UTMZone=item_2,
    TranslationVector=item_2,
    CroppingGeometry=item_2,
    ImportAltitude=False)  # -> Points, Metadata, UTMZone, TranslationVector
import_osm_features_8 = ImportOSMFeatures(
    OSMPathOrURL=path,
    OSMFeatureType="public_transport",
    Format="xml",
    UTMZone=item_2,
    TranslationVector=item_2,
    CroppingGeometry=item_2,
    ImportAltitude=False)  # -> Points, Metadata, UTMZone, TranslationVector
data_14 = Data(flatten(import_osm_features_8.Points))
data_15 = Data(flatten(import_osm_features_7.Points))
lookup_2 = LookupMetadata(MetadataGeometry=import_osm_features_7.Metadata, SearchKey="public_transport")  # -> flatten(Value)
lookup_3 = LookupMetadata(MetadataGeometry=import_osm_features_8.Metadata, SearchKey="public_transport")  # -> flatten(Value)
panel_16 = Panel(lookup_3)
panel_17 = Panel(lookup_2)
python_stop = GhPythonScript(x=panel_17)  # -> out, a, b; inputs x: list
# ---------- python_stop: Python ----------
import Rhino.Geometry as rg
storelist = []
storeind = []


for i in range(len(x)):
    if(x[i] != None):
        if(x[i].find('stop') != -1):
            slist =x[i]
            sind = i
            storelist.append(slist)
            storeind.append(sind)


a = storelist
b = storeind
# ---------- end python_stop ----------
python_platform = GhPythonScript(x=panel_17)  # -> out, a, b; inputs x: list
# ---------- python_platform: Python ----------
import Rhino.Geometry as rg
storelist = []
storeind = []


for i in range(len(x)):
    if(x[i] != None):
        if(x[i].find('station') != -1):
            slist =x[i]
            sind = i
            storelist.append(slist)
            storeind.append(sind)


a = storelist
b = storeind
# ---------- end python_platform ----------
python_stop_2 = GhPythonScript(x=panel_16)  # -> out, a, b; inputs x: list
# ---------- python_stop_2: Python ----------
import Rhino.Geometry as rg
storelist = []
storeind = []

for i in range(len(x)):
    if(x[i] != None):
        if(x[i].find('stop') != -1):
            slist =x[i]
            sind = i
            storelist.append(slist)
            storeind.append(sind)


a = storelist
b = storeind
# ---------- end python_stop_2 ----------
python_platform_2 = GhPythonScript(x=panel_16)  # -> out, a, b; inputs x: list
# ---------- python_platform_2: Python ----------
import Rhino.Geometry as rg
storelist = []
storeind = []


for i in range(len(x)):
    if(x[i] != None):
        if(x[i].find('platform') != -1):
            slist =x[i]
            sind = i
            storelist.append(slist)
            storeind.append(sind)


a = storelist
b = storeind
# ---------- end python_platform_2 ----------
panel_18 = Panel(python_stop_2.b)
panel_19 = Panel(python_platform_2.b)
panel_20 = Panel(python_platform.b)
panel_21 = Panel(python_stop.b)
item_5 = ListItem(List=data_14, Index=panel_18, Wrap=True)
item_6 = ListItem(List=data_14, Index=panel_19, Wrap=True)
item_7 = ListItem(List=data_15, Index=panel_21, Wrap=True)
item_8 = ListItem(List=data_15, Index=panel_20, Wrap=True)
stop_points = Data(item_7)
platform = Data(item_6)
station = Data(item_8)
stop = Data(item_5)
area_8 = Area(Geometry=item_2)  # -> Area, Centroid
area_9 = Area(Geometry=item_2)  # -> Area, Centroid
area_10 = Area(Geometry=item_2)  # -> Area, Centroid
area_11 = Area(Geometry=item_2)  # -> Area, Centroid
# input a path to save the csv
number_slider_7 = Slider(28.5, range=0..100)
rotate_7 = Rotate(Geometry=platform, Angle=degrees(number_slider_7), Plane=area_8.Centroid)  # -> Geometry, Transform
rotate_8 = Rotate(Geometry=stop, Angle=degrees(Slider(28.5, range=0..100)), Plane=area_9.Centroid)  # -> Geometry, Transform
rotate_9 = Rotate(Geometry=station, Angle=degrees(Slider(28.5, range=0..100)), Plane=area_10.Centroid)  # -> Geometry, Transform
rotate_10 = Rotate(Geometry=stop_points, Angle=degrees(Slider(28.5, range=0..100)), Plane=area_11.Centroid)  # -> Geometry, Transform
move_7 = Move(Geometry=rotate_10.Geometry, Motion=vec2pt.Vector)  # -> Geometry, Transform
move_8 = Move(Geometry=rotate_9.Geometry, Motion=vec2pt.Vector)  # -> Geometry, Transform
move_9 = Move(Geometry=rotate_8.Geometry, Motion=vec2pt.Vector)  # -> Geometry, Transform
move_10 = Move(Geometry=rotate_7.Geometry, Motion=vec2pt.Vector)  # -> Geometry, Transform

cir_3 = Circle(Plane=move_7.Geometry, Radius=1)
cir_4 = Circle(Plane=move_8.Geometry, Radius=1)
cir_5 = Circle(Plane=[move_9.Geometry, move_10.Geometry], Radius=1)
boundary_5 = BoundarySurfaces(Edges=cir_4)
boundary_6 = BoundarySurfaces(Edges=cir_3)
boundary_7 = BoundarySurfaces(Edges=cir_5)

bake_10 = GhPythonScript(geo=boundary_6, layer="Train_station", mSrc=0, active=button)  # -> out; inputs mSrc: Int32; same code as bake
bake_11 = GhPythonScript(geo=boundary_7, layer="Bus_station", mSrc=0, active=button)  # -> out; inputs mSrc: Int32; same code as bake

# ----
# PHARMACY
# BANK
# STORES
panel_22 = Panel("amenity")
lookup_4 = LookupMetadata(MetadataGeometry=import_osm_features_2.Metadata, SearchKey=panel_22)  # -> flatten(Value)
panel_23 = Panel(lookup_4)
data_16 = Data(flatten(move_6.Geometry))
data_17 = Data(move_3.Geometry)
python = GhPythonScript(x=panel_23)  # -> out, a, b; inputs x: list
# ---------- python: Python ----------
import Rhino.Geometry as rg
storelist = []
storeind = []


for i in range(len(x)):
    if(x[i].find('store') != -1):
        slist =x[i]
        sind = i
        storelist.append(slist)
        storeind.append(sind)


a = storelist
b = storeind
# ---------- end python ----------
python_2 = GhPythonScript(x=panel_23)  # -> out, a, b; inputs x: list
# ---------- python_2: Python ----------
import Rhino.Geometry as rg
storelist = []
storeind = []


for i in range(len(x)):
    if(x[i].find('bank') != -1):
        slist =x[i]
        sind = i
        storelist.append(slist)
        storeind.append(sind)


a = storelist
b = storeind
# ---------- end python_2 ----------
python_3 = GhPythonScript(x=panel_23)  # -> out, a, b; inputs x: list
# ---------- python_3: Python ----------
import Rhino.Geometry as rg
storelist = []
storeind = []


for i in range(len(x)):
    if(x[i].find('pharmacy') != -1):
        slist =x[i]
        sind = i
        storelist.append(slist)
        storeind.append(sind)


a = storelist
b = storeind
# ---------- end python_3 ----------
python_4 = GhPythonScript(x=panel_23)  # -> out, a, b; inputs x: list
# ---------- python_4: Python ----------
import Rhino.Geometry as rg
storelist = []
storeind = []


for i in range(len(x)):
    if(x[i].find('cafe') != -1 or x[i].find('restaurant') != -1 or x[i].find('food') != -1 or x[i].find('bar') != -1 or x[i].find('pub') != -1) :
        slist =x[i]
        sind = i
        storelist.append(slist)
        storeind.append(sind)


a = storelist
b = storeind
# ---------- end python_4 ----------
panel_24 = Panel(python_2.a)
panel_25 = Panel(python_2.b)
panel_26 = Panel(python_3.a)
# FOOD AND DRINKS
panel_27 = Panel(python_4.a)
panel_28 = Panel(python_3.b)
panel_29 = Panel(python_4.b)
panel_30 = Panel(python.b)
panel_31 = Panel(python.a)
item_9 = ListItem(List=data_16, Index=panel_25, Wrap=True)
item_10 = ListItem(List=data_16, Index=panel_28, Wrap=True)
item_11 = ListItem(List=data_16, Index=panel_29, Wrap=True)
item_12 = ListItem(List=data_16, Index=panel_30, Wrap=True)
store = Data(item_9)
store_2 = Data(item_10)
store_3 = Data(item_11)
store_4 = Data(item_12)
Z_4 = UnitZ(Factor=1)
Z_5 = UnitZ(Factor=1)
Z_6 = UnitZ(Factor=1)
Z_7 = UnitZ(Factor=1)
move_11 = Move(Geometry=store, Motion=Z_4)  # -> Geometry, Transform
move_12 = Move(Geometry=store_2, Motion=Z_5)  # -> Geometry, Transform
move_13 = Move(Geometry=store_3, Motion=Z_6)  # -> Geometry, Transform
move_14 = Move(Geometry=store_4, Motion=Z_7)  # -> Geometry, Transform
brepsinc = PointInBreps(Brep=data_17, Point=move_11.Geometry, Strict=False)  # -> Inside, Index
brepsinc_2 = PointInBreps(Brep=data_17, Point=move_12.Geometry, Strict=False)  # -> Inside, Index
brepsinc_3 = PointInBreps(Brep=data_17, Point=move_13.Geometry, Strict=False)  # -> Inside, Index
brepsinc_4 = PointInBreps(Brep=data_17, Point=move_14.Geometry, Strict=False)  # -> Inside, Index

python_5 = GhPythonScript(x=brepsinc.Index)  # -> out, a; inputs x: list of Int32
# ---------- python_5: Python ----------
import Rhino.Geometry as rg

newlist = []
for i in x:
    if i != -1:
        newlist.append(i)


a = newlist
# ---------- end python_5 ----------
python_6 = GhPythonScript(x=brepsinc_3.Index)  # -> out, a; inputs x: list of Int32; same code as python_5
python_7 = GhPythonScript(x=brepsinc_2.Index)  # -> out, a; inputs x: list of Int32; same code as python_5
python_8 = GhPythonScript(x=brepsinc_4.Index)  # -> out, a; inputs x: list of Int32; same code as python_5

item_13 = ListItem(List=data_17, Index=python_5.a, Wrap=True)
item_14 = ListItem(List=data_17, Index=python_7.a, Wrap=True)
item_15 = ListItem(List=data_17, Index=python_6.a, Wrap=True)
data_18 = Data(item_13)
item_16 = ListItem(List=data_17, Index=python_8.a, Wrap=True)
data_19 = Data(item_14)
data_20 = Data(item_15)
data_21 = Data(item_16)
bake_12 = GhPythonScript(geo=data_19, layer="Pharmacy", mSrc=0, active=button)  # -> out; inputs mSrc: Int32; same code as bake
bake_13 = GhPythonScript(geo=data_20, layer="Food_and_drinks", mSrc=0, active=button)  # -> out; inputs mSrc: Int32; same code as bake
bake_14 = GhPythonScript(geo=data_18, layer="Bank", mSrc=0, active=button)  # -> out; inputs mSrc: Int32; same code as bake
bake_15 = GhPythonScript(geo=data_21, layer="Stores", mSrc=0, active=button)  # -> out; inputs mSrc: Int32; same code as bake

merge = Merge(Data1=python_8.a, Data2=python_5.a, Data3=python_7.a, Data4=python_6.a)
cull_i = CullIndex(List=move_3.Geometry, Indices=merge, Wrap=True)  # -> flatten(List)
null = NullItem(Item=cull_i)  # -> NullFlags, InvalidFlags, Description
dispatch_2 = Dispatch(List=cull_i, DispatchPattern=null.NullFlags)  # -> ListA, ListB
bake_16 = GhPythonScript(geo=dispatch_2.ListB, layer="Other_Buildings", mSrc=0, active=button)  # -> out; inputs mSrc: Int32; same code as bake

# ==== cluster CroppedStreetNetwork
data = ClusterInput()
crv = ClusterInput()

data_2 = Data(data)
crv_2 = Curve(crv)
offset = OffsetCurve(Curve=crv_2, Distance=Slider(200, range=0..1000), Plane=PlaneXY(0, 0, 0), Corners=1)
incurve = PointInCurve(Point=data_2, Curve=graft(offset))  # -> Relationship, Point
larger = LargerThan(FirstNumber=incurve.Relationship, SecondNumber="1")  # -> LargerThan, OrEqualTo
dispatch = Dispatch(List=data_2, DispatchPattern=larger.OrEqualTo)  # -> ListA, ListB
data_3 = Data(simplify(dispatch.ListA))
pline = PolyLine(Vertices=data_3, Closed=False)
null = NullItem(Item=pline)  # -> NullFlags, InvalidFlags, Description
dispatch_2 = Dispatch(List=pline, DispatchPattern=null.NullFlags)  # -> ListA, ListB
data_4 = Data(flatten(dispatch_2.ListB))
join = JoinCurves(Curves=data_4, Preserve=False)  # -> graft(Curves)
ccx = CurveCurve(CurveA=crv_2, CurveB=join)  # -> Points, ParamsA, ParamsB
shatter = Shatter(Curve=join, Parameters=ccx.ParamsB)
curvepoint = PointOnCurve(shatter, parameter=0.511)
incurve_2 = PointInCurve(Point=curvepoint, Curve=crv_2)  # -> Relationship, Point
smaller = SmallerThan(FirstNumber=incurve_2.Relationship, SecondNumber="1")  # -> SmallerThan, OrEqualTo
dispatch_3 = Dispatch(List=shatter, DispatchPattern=smaller.OrEqualTo)  # -> ListA, ListB
data_5 = Data(flatten(dispatch_3.ListB))

data_6 = ClusterOutput(data_5)

# ==== cluster RoadWithCrossWalk
data = ClusterInput()
# Roads with Cross-Walk
data_2 = Data(data)
Z = UnitZ(Factor="-4")
Z_2 = UnitZ(Factor=Slider(4, range=0..10))

ptuvcrvs = IntersectCurves(CU=data_2, CV=data_2)
data_3 = Data(flatten(ptuvcrvs))
pdecon = Deconstruct(Point=data_3)  # -> XComponent, YComponent, ZComponent
number_slider = Slider(12, range=0..100)
null = NullItem(Item=pdecon.XComponent)  # -> NullFlags, InvalidFlags, Description
dispatch = Dispatch(List=data_3, DispatchPattern=null.NullFlags)  # -> ListA, ListB
python = GhPythonScript(x=dispatch.ListB)  # -> out, a; inputs x: list of Point3d
# ---------- python: Python ----------
import Rhino.Geometry as rg

pt1 =[]

for i in range(len(x)-1):
    l1=[]

    line1 = rg.Line(x[i],x[i+1])
    len1 =line1.Length
    if len1 >= 100:
        pt1.append(x[i])
        pt1.append(x[i+1])


a =pt1
# ---------- end python ----------
Z_3 = UnitZ(Factor=number_slider)
Z_4 = UnitZ(Factor=number_slider)
cir = Circle(Plane=python.a, Radius=Slider(15, range=0..100))
data_4 = Data(graft(cir))
extr = Extrude(Base=data_4, Direction=Z_4)
bcx = BrepCurve(Brep=extr, Curve=data_2)  # -> Curves, Points
number_slider_2 = Slider(6, range=0..10)
center = Center(Geometry=bcx.Points)  # -> Center, Dimension
polygon = Polygon(Plane=bcx.Points, Radius=number_slider_2, Segments=number_slider_2, FilletRadius=0)  # -> Polygon, Length
rotate = Rotate(Geometry=polygon.Polygon, Angle=degrees(Slider(18, range=0..100)), Plane=center.Center)  # -> Geometry, Transform
extr_2 = Extrude(Base=rotate.Geometry, Direction=Z_4)
bcx_2 = BrepCurve(Brep=extr_2, Curve=data_2)  # -> Curves, Points
crv_cp = CurveClosestPoint(Point=bcx_2.Points, Curve=data_2)  # -> Point, flatten(Parameter), Distance
boundary = BoundarySurfaces(Edges=rotate.Geometry)
shatter = Shatter(Curve=graft(data_2), Parameters=crv_cp.Parameter)  # -> flatten(Segments)
extr_3 = Extrude(Base=boundary, Direction=Z_3)  # -> flatten(Extrusion)
curvepoint = PointOnCurve(shatter, parameter=0.509)
brepsinc = PointInBreps(Brep=extr_3, Point=curvepoint, Strict=False)  # -> Inside, Index
dispatch_2 = Dispatch(List=shatter, DispatchPattern=brepsinc.Inside)  # -> ListA, ListB
number_slider_3 = Slider(3, range=0..10)
join = JoinCurves(Curves=dispatch_2.ListB, Preserve=False)
offcrv = OffsetCurve(
    Curve=join,
    Plane=PlaneXY(0, 0, 0),
    Distance=number_slider_3,
    BothSides=Toggle(True),
    Kinks=0,
    CapType=Slider(2, range=0..10))

polyoffset = PolylineOffset(
    Polylines=join,
    Distance=number_slider_3,
    Plane=Plane(origin=(0, 0, 0), x=(0, 0, 0), y=(0, 0, 0)),
    Tolerance=0.01,
    ClosedFillet=1,
    OpenFillet=1,
    Miter=2)  # -> Contour, Holes
C = ClusterOutput(polyoffset.Contour)

boundary_2 = BoundarySurfaces(Edges=polyoffset.Contour)

data_5 = Data(boundary_2)
data_6 = ClusterOutput(data_5)
move = Move(Geometry=boundary_2, Motion=Z)  # -> Geometry, Transform
extr_4 = Extrude(Base=move.Geometry, Direction=Z_2)
E = ClusterOutput(extr_4)

# ==== cluster GatePoints
data = ClusterInput()
# Gate Points
relay = ClusterInput()
C = ClusterInput()

data_2 = Data(data)
ccx = CurveCurve(CurveA=relay, CurveB=data_2, UseTasks=False)  # -> Points, ParamsA, ParamsB
cir = Circle(Plane=ccx.Points, Radius=Slider(4, range=0..10))
ccx_2 = CurveCurve(CurveA=relay, CurveB=cir, UseTasks=False)  # -> Points, ParamsA, ParamsB
null = NullItem(Item=ccx_2.Points)  # -> NullFlags, InvalidFlags, Description
dispatch = Dispatch(List=ccx_2.Points, DispatchPattern=null.NullFlags)  # -> ListA, ListB
data_3 = Data(flatten(dispatch.ListB))
python = GhPythonScript(x=data_3)  # -> out, a; inputs x: list of Point3d
# ---------- python: Python ----------
import Rhino.Geometry as rg

pt1 =[]

for i in range(len(x)-1):
    l1=[]

    line1 = rg.Line(x[i],x[i+1])
    len1 =line1.Length
    if len1 >= 250:
        pt1.append(x[i])
        pt1.append(x[i+1])


a =pt1
# ---------- end python ----------
incurves = PointInCurves(Point=data_3, Curves=flatten(C))  # -> Relationship, Index, Point
dispatch_2 = Dispatch(List=data_3, DispatchPattern=incurves.Relationship)  # -> ListA, ListB
gates = Data(dispatch_2.ListB)

data_4 = Data(relay)
area = Area(Geometry=data_4)  # -> Area, Centroid
vec2pt = Vector2Pt(PointA=gates, PointB=area.Centroid, Unitize=False)  # -> Vector, Length
amp = Amplitude(Vector=vec2pt.Vector, Amplitude=Slider(12, range=0..100))
move = Move(Geometry=gates, Motion=amp)  # -> Geometry, Transform
B = ClusterInput()
brepsinc = PointInBreps(Brep=B, Point=move.Geometry, Strict=False)  # -> Inside, Index
item = ListItem(List=move.Geometry, Index=brepsinc.Index, Wrap=True)
i = ClusterOutput(item)
